# Requirement set crs_req_func_ears (R2026b)
Draft EARS rewrite of crs_req_func_spec.slreqx. Review and approve before baselining.

## 1 [#1] Driver Switch Request Handling
The cruise control controller shall convert driver switch inputs into a driver request command.
Rationale: EARS rewrite of source requirement #1; technical intent requires engineering review before approval.
Keywords: draft, EARS, source-linked
EARS_Pattern: Ubiquitous

### 1.1 [#2] Switch precedence
When multiple driver switches are active simultaneously, the cruise control controller shall apply the precedence Cancel, Cruise, Set, Resume, Increment, then Decrement.
Rationale: EARS rewrite of source requirement #2; technical intent requires engineering review before approval.
Keywords: draft, EARS, source-linked
EARS_Pattern: Event-driven

### 1.2 [#3] Avoid repeating commands
While Cancel, Cruise, Set, or Resume remains continuously active after its first accepted request, the cruise control controller shall output reqMode.NoRequest.
Rationale: EARS rewrite of source requirement #3; technical intent requires engineering review before approval.
Keywords: draft, EARS, source-linked
EARS_Pattern: State-driven

### 1.3 [#4] Long Switch recognition
When the Increment or Decrement switch remains pressed for at least 500 ms, the cruise control controller shall classify the request as reqMode.Inc_Long or reqMode.Dec_Long, respectively.
Rationale: EARS rewrite of source requirement #4; technical intent requires engineering review before approval.
Keywords: draft, EARS, source-linked
EARS_Pattern: Event-driven

#### 1.3.1 [#5] Waiting state for Long Increment switch detection
While the Increment switch remains pressed for less than 500 ms, the cruise control controller shall output reqMode.Inc_Middle until long-press classification is reached.
Rationale: EARS rewrite of source requirement #5; technical intent requires engineering review before approval.
Keywords: draft, EARS, source-linked
EARS_Pattern: State-driven

#### 1.3.2 [#6] Waiting state for Long Decrement switch detection
While the Decrement switch remains pressed for less than 500 ms, the cruise control controller shall output reqMode.Dec_Middle until long-press classification is reached.
Rationale: EARS rewrite of source requirement #6; technical intent requires engineering review before approval.
Keywords: draft, EARS, source-linked
EARS_Pattern: State-driven

### 1.4 [#7] Cancel Switch Detection
When the Cancel switch is pressed, the cruise control controller shall set reqDrv to reqMode.Cancel.
Rationale: EARS rewrite of source requirement #7; technical intent requires engineering review before approval.
Keywords: draft, EARS, source-linked
EARS_Pattern: Event-driven

### 1.5 [#8] Set Switch Detection
When the Set switch is pressed, the cruise control controller shall set reqDrv to reqMode.Set.
Rationale: EARS rewrite of source requirement #8; technical intent requires engineering review before approval.
Keywords: draft, EARS, source-linked
EARS_Pattern: Event-driven

### 1.6 [#9] Enable Switch Detection
When the Enable switch is pressed, the cruise control controller shall set reqDrv to reqMode.Cruise.
Rationale: EARS rewrite of source requirement #9; technical intent requires engineering review before approval.
Keywords: draft, EARS, source-linked
EARS_Pattern: Event-driven

### 1.7 [#10] Resume Switch Detection
When the Resume switch is pressed, the cruise control controller shall set reqDrv to reqMode.Resume.
Rationale: EARS rewrite of source requirement #10; technical intent requires engineering review before approval.
Keywords: draft, EARS, source-linked
EARS_Pattern: Event-driven

### 1.8 [#11] Increment Switch Detection
When the Increment switch is pressed, the cruise control controller shall set reqDrv to reqMode.Inc_Short, reqMode.Inc_Middle, or reqMode.Inc_Long according to the press duration.
Rationale: EARS rewrite of source requirement #11; technical intent requires engineering review before approval.
Keywords: draft, EARS, source-linked
EARS_Pattern: Event-driven

#### 1.8.1 [#12] Increment Short Switch Detection
When the Increment switch is released before the 500 ms long-press threshold, the cruise control controller shall set reqDrv to reqMode.Inc_Short.
Rationale: EARS rewrite of source requirement #12; technical intent requires engineering review before approval.
Keywords: draft, EARS, source-linked
EARS_Pattern: Event-driven

#### 1.8.2 [#13] Increment Long Switch Detection
When the Increment switch remains pressed for at least 500 ms, the cruise control controller shall set reqDrv to reqMode.Inc_Long.
Rationale: EARS rewrite of source requirement #13; technical intent requires engineering review before approval.
Keywords: draft, EARS, source-linked
EARS_Pattern: Event-driven

#### 1.8.3 [#14] Intermediate state
While the Increment switch remains pressed and the 500 ms long-press threshold has not been reached, the cruise control controller shall set reqDrv to reqMode.Inc_Middle.
Rationale: EARS rewrite of source requirement #14; technical intent requires engineering review before approval.
Keywords: draft, EARS, source-linked
EARS_Pattern: State-driven

### 1.9 [#15] Decrement Switch Detection
When the Decrement switch is pressed, the cruise control controller shall set reqDrv to reqMode.Dec_Short, reqMode.Dec_Middle, or reqMode.Dec_Long according to the press duration.
Rationale: EARS rewrite of source requirement #15; technical intent requires engineering review before approval.
Keywords: draft, EARS, source-linked
EARS_Pattern: Event-driven

#### 1.9.1 [#16] Decrement Short Switch Detection
When the Decrement switch is released before the 500 ms long-press threshold, the cruise control controller shall set reqDrv to reqMode.Dec_Short.
Rationale: EARS rewrite of source requirement #16; technical intent requires engineering review before approval.
Keywords: draft, EARS, source-linked
EARS_Pattern: Event-driven

#### 1.9.2 [#17] Decrement Long Switch Detection
When the Decrement switch remains pressed for at least 500 ms, the cruise control controller shall set reqDrv to reqMode.Dec_Long.
Rationale: EARS rewrite of source requirement #17; technical intent requires engineering review before approval.
Keywords: draft, EARS, source-linked
EARS_Pattern: Event-driven

#### 1.9.3 [#18] Intermediate state
While the Decrement switch remains pressed and the 500 ms long-press threshold has not been reached, the cruise control controller shall set reqDrv to reqMode.Dec_Middle.
Rationale: EARS rewrite of source requirement #18; technical intent requires engineering review before approval.
Keywords: draft, EARS, source-linked
EARS_Pattern: State-driven

## 2 [#19] Cruise Control Mode
The cruise control controller shall determine its operating mode from the driver request and environmental conditions and shall provide the instrument-panel status.
Rationale: EARS rewrite of source requirement #19; technical intent requires engineering review before approval.
Keywords: draft, EARS, source-linked
EARS_Pattern: Ubiquitous

### 2.1 [#20] Disable Cruise Control system
If any cruise-control disable condition is true, then the cruise control controller shall enter the Disabled mode.
Rationale: EARS rewrite of source requirement #20; technical intent requires engineering review before approval.
Keywords: draft, EARS, source-linked
EARS_Pattern: Unwanted behavior

#### 2.1.1 [#21] Key position is not ON
If the key position is not ON, then the cruise control controller shall enter the Disabled mode.
Rationale: EARS rewrite of source requirement #21; technical intent requires engineering review before approval.
Keywords: draft, EARS, source-linked
EARS_Pattern: Unwanted behavior

#### 2.1.2 [#22] Gear position is not Drive
If the gear position is not Drive, then the cruise control controller shall enter the Disabled mode.
Rationale: EARS rewrite of source requirement #22; technical intent requires engineering review before approval.
Keywords: draft, EARS, source-linked
EARS_Pattern: Unwanted behavior

#### 2.1.3 [#23] Brake pressure is higher than brake_threshold
If brake pressure is greater than brake_threshold (5), then the cruise control controller shall enter the Disabled mode.
Rationale: EARS rewrite of source requirement #23; technical intent requires engineering review before approval.
Keywords: draft, EARS, source-linked
EARS_Pattern: Unwanted behavior

### 2.2 [#24] Operation mode determination
When a driver request or environmental condition is evaluated, the cruise control controller shall determine the current operating mode from that input and the previous operating mode.
Rationale: EARS rewrite of source requirement #24; technical intent requires engineering review before approval.
Keywords: draft, EARS, source-linked
EARS_Pattern: Event-driven

#### 2.2.1 [#25] Precedence of mode determination
When multiple mode-transition conditions are true simultaneously, the cruise control controller shall apply the precedence Disable, Enable, Resume, Activate, Increment, then Decrement.
Rationale: EARS rewrite of source requirement #25; technical intent requires engineering review before approval.
Keywords: draft, EARS, source-linked
EARS_Pattern: Event-driven

#### 2.2.2 [#26] Disable conditions
If a disable condition is true, then the cruise control controller shall request the Disabled mode.
Rationale: EARS rewrite of source requirement #26; technical intent requires engineering review before approval.
Keywords: draft, EARS, source-linked
EARS_Pattern: Unwanted behavior

#### 2.2.3 [#27] Enable conditions
When all enable conditions are satisfied, the cruise control controller shall request the Enabled mode.
Rationale: EARS rewrite of source requirement #27; technical intent requires engineering review before approval.
Keywords: draft, EARS, source-linked
EARS_Pattern: Event-driven

#### 2.2.4 [#28] Resume conditions
When all resume conditions are satisfied, the cruise control controller shall request the Resume mode.
Rationale: EARS rewrite of source requirement #28; technical intent requires engineering review before approval.
Keywords: draft, EARS, source-linked
EARS_Pattern: Event-driven

#### 2.2.5 [#29] Activate conditions
When all activation conditions are satisfied, the cruise control controller shall request the Activated mode.
Rationale: EARS rewrite of source requirement #29; technical intent requires engineering review before approval.
Keywords: draft, EARS, source-linked
EARS_Pattern: Event-driven

#### 2.2.6 [#30] Repeat previous operation mode
When no mode-transition condition is true, the cruise control controller shall retain the previous operating mode.
Rationale: EARS rewrite of source requirement #30; technical intent requires engineering review before approval.
Keywords: draft, EARS, source-linked
EARS_Pattern: Event-driven

#### 2.2.7 [#31] Increment mode
While the cruise control controller is in increment mode, the controller shall increase the target speed.
Rationale: EARS rewrite of source requirement #31; technical intent requires engineering review before approval.
Keywords: draft, EARS, source-linked
EARS_Pattern: State-driven

#### 2.2.8 [#32] Increment and hold mode
While the cruise control controller is in increment-and-hold mode, the controller shall increase and retain the target speed.
Rationale: EARS rewrite of source requirement #32; technical intent requires engineering review before approval.
Keywords: draft, EARS, source-linked
EARS_Pattern: State-driven

#### 2.2.9 [#33] Decrement mode
While the cruise control controller is in decrement mode, the controller shall decrease the target speed.
Rationale: EARS rewrite of source requirement #33; technical intent requires engineering review before approval.
Keywords: draft, EARS, source-linked
EARS_Pattern: State-driven

#### 2.2.10 [#34] Decrement and hold mode
While the cruise control controller is in decrement-and-hold mode, the controller shall decrease and retain the target speed.
Rationale: EARS rewrite of source requirement #34; technical intent requires engineering review before approval.
Keywords: draft, EARS, source-linked
EARS_Pattern: State-driven

#### 2.2.11 [#35] Out of speed range detection
If vehicle speed is less than tsp_min (40) or greater than tsp_max (100), then the cruise control controller shall assert the out-of-range flag.
Rationale: EARS rewrite of source requirement #35; technical intent requires engineering review before approval.
Keywords: draft, EARS, source-linked
EARS_Pattern: Unwanted behavior

#### 2.2.12 [#36] Disabling override
If any disable condition is true, then the cruise control controller shall select Disabled mode regardless of lower-priority mode requests.
Rationale: EARS rewrite of source requirement #36; technical intent requires engineering review before approval.
Keywords: draft, EARS, source-linked
EARS_Pattern: Unwanted behavior

## 3 [#37] Calculate Target Speed and Throttle Value
The cruise control controller shall calculate target speed and throttle command from operating mode, vehicle speed, and driver throttle input.
Rationale: EARS rewrite of source requirement #37; technical intent requires engineering review before approval.
Keywords: draft, EARS, source-linked
EARS_Pattern: Ubiquitous

### 3.1 [#38] Disabled case
While the operating mode is Disabled, the cruise control controller shall set the throttle command to the driver throttle input and the target speed to tsp_min (40).
Rationale: EARS rewrite of source requirement #38; technical intent requires engineering review before approval.
Keywords: draft, EARS, source-linked
EARS_Pattern: State-driven

### 3.2 [#39] Enabled case
While the operating mode is Enabled, the cruise control controller shall set target speed to current vehicle speed and throttle command to the driver throttle input.
Rationale: EARS rewrite of source requirement #39; technical intent requires engineering review before approval.
Keywords: draft, EARS, source-linked
EARS_Pattern: State-driven

### 3.3 [#40] Activated case
While the operating mode is Activated, the cruise control controller shall compute target speed and throttle command according to the active-control requirements.
Rationale: EARS rewrite of source requirement #40; technical intent requires engineering review before approval.
Keywords: draft, EARS, source-linked
EARS_Pattern: State-driven

#### 3.3.1 [#41] Throttle Value Computation
While the operating mode is Activated, the cruise control controller shall compute the throttle command from target speed, vehicle speed, driver throttle input, Kp (20), and Ki (0.199980865671134).
Rationale: EARS rewrite of source requirement #41; technical intent requires engineering review before approval.
Keywords: draft, EARS, source-linked
EARS_Pattern: State-driven

#### 3.3.2 [#42] Next Target Speed Computation
While the operating mode is Activated, when an increment or decrement request is received, the cruise control controller shall compute the next target speed.
Rationale: EARS rewrite of source requirement #42; technical intent requires engineering review before approval.
Keywords: draft, EARS, source-linked
EARS_Pattern: Combined

### 3.4 [#43] Resume mode
While the operating mode is Resume, the cruise control controller shall restore the stored target speed and then compute target speed and throttle command as in Activated mode.
Rationale: EARS rewrite of source requirement #43; technical intent requires engineering review before approval.
Keywords: draft, EARS, source-linked
EARS_Pattern: State-driven

## 4 [#44] System Interface (Container)
Rationale: Structural container retained from source requirement #44.
Keywords: draft, EARS-structure, source-linked
EARS_Pattern: Not applicable

### 4.1 [#45] Inputs (Container)
Rationale: Structural container retained from source requirement #45.
Keywords: draft, EARS-structure, source-linked
EARS_Pattern: Not applicable

#### 4.1.1 [#46] Enable Switch
The cruise control controller shall accept the Enable switch input as a Boolean signal.
Rationale: EARS rewrite of source requirement #46; technical intent requires engineering review before approval.
Keywords: draft, EARS, source-linked
EARS_Pattern: Ubiquitous

#### 4.1.2 [#47] Cancel Switch
The cruise control controller shall accept the Cancel switch input as a Boolean signal.
Rationale: EARS rewrite of source requirement #47; technical intent requires engineering review before approval.
Keywords: draft, EARS, source-linked
EARS_Pattern: Ubiquitous

#### 4.1.3 [#48] Set Switch
The cruise control controller shall accept the Set switch input as a Boolean signal.
Rationale: EARS rewrite of source requirement #48; technical intent requires engineering review before approval.
Keywords: draft, EARS, source-linked
EARS_Pattern: Ubiquitous

#### 4.1.4 [#49] Resume Switch
The cruise control controller shall accept the Resume switch input as a Boolean signal.
Rationale: EARS rewrite of source requirement #49; technical intent requires engineering review before approval.
Keywords: draft, EARS, source-linked
EARS_Pattern: Ubiquitous

#### 4.1.5 [#50] Increment Switch
The cruise control controller shall accept the Increment switch input as a Boolean signal.
Rationale: EARS rewrite of source requirement #50; technical intent requires engineering review before approval.
Keywords: draft, EARS, source-linked
EARS_Pattern: Ubiquitous

#### 4.1.6 [#51] Decrement Switch
The cruise control controller shall accept the Decrement switch input as a Boolean signal.
Rationale: EARS rewrite of source requirement #51; technical intent requires engineering review before approval.
Keywords: draft, EARS, source-linked
EARS_Pattern: Ubiquitous

#### 4.1.7 [#52] Brake pressure
The cruise control controller shall accept brake pressure as an input signal.
Rationale: EARS rewrite of source requirement #52; technical intent requires engineering review before approval.
Keywords: draft, EARS, source-linked
EARS_Pattern: Ubiquitous

#### 4.1.8 [#53] Vehicle speed
The cruise control controller shall accept vehicle speed as an input signal.
Rationale: EARS rewrite of source requirement #53; technical intent requires engineering review before approval.
Keywords: draft, EARS, source-linked
EARS_Pattern: Ubiquitous

#### 4.1.9 [#54] Key position
The cruise control controller shall accept key position as an input signal.
Rationale: EARS rewrite of source requirement #54; technical intent requires engineering review before approval.
Keywords: draft, EARS, source-linked
EARS_Pattern: Ubiquitous

#### 4.1.10 [#55] Gear position
The cruise control controller shall accept gear position as an input signal.
Rationale: EARS rewrite of source requirement #55; technical intent requires engineering review before approval.
Keywords: draft, EARS, source-linked
EARS_Pattern: Ubiquitous

#### 4.1.11 [#56] Throttle from Driver
The cruise control controller shall accept driver throttle position as an input signal.
Rationale: EARS rewrite of source requirement #56; technical intent requires engineering review before approval.
Keywords: draft, EARS, source-linked
EARS_Pattern: Ubiquitous

### 4.2 [#57] Outputs (Container)
Rationale: Structural container retained from source requirement #57.
Keywords: draft, EARS-structure, source-linked
EARS_Pattern: Not applicable

#### 4.2.1 [#58] Driver Request
The cruise control controller shall provide reqDrv as a reqMode enumeration.
Rationale: EARS rewrite of source requirement #58; technical intent requires engineering review before approval.
Keywords: draft, EARS, source-linked
EARS_Pattern: Ubiquitous

#### 4.2.2 [#59] Status
The cruise control controller shall provide status as a Boolean signal.
Rationale: EARS rewrite of source requirement #59; technical intent requires engineering review before approval.
Keywords: draft, EARS, source-linked
EARS_Pattern: Ubiquitous

#### 4.2.3 [#60] Operation Mode
The cruise control controller shall provide the operating mode as an opMode enumeration.
Rationale: EARS rewrite of source requirement #60; technical intent requires engineering review before approval.
Keywords: draft, EARS, source-linked
EARS_Pattern: Ubiquitous

#### 4.2.4 [#61] Target Speed
The cruise control controller shall provide target speed as a single-precision signal.
Rationale: EARS rewrite of source requirement #61; technical intent requires engineering review before approval.
Keywords: draft, EARS, source-linked
EARS_Pattern: Ubiquitous

#### 4.2.5 [#62] Throttle value
The cruise control controller shall provide throttle command as a single-precision signal.
Rationale: EARS rewrite of source requirement #62; technical intent requires engineering review before approval.
Keywords: draft, EARS, source-linked
EARS_Pattern: Ubiquitous

### 4.3 [#63] Parameters (Container)
Rationale: Structural container retained from source requirement #63.
Keywords: draft, EARS-structure, source-linked
EARS_Pattern: Not applicable

#### 4.3.1 [#64] Proportional term
The cruise control controller shall use Kp (20) as the proportional gain of the PI controller.
Rationale: EARS rewrite of source requirement #64; technical intent requires engineering review before approval.
Keywords: draft, EARS, source-linked
EARS_Pattern: Ubiquitous

#### 4.3.2 [#65] Integral term
The cruise control controller shall use Ki (0.199980865671134) as the integral gain of the PI controller.
Rationale: EARS rewrite of source requirement #65; technical intent requires engineering review before approval.
Keywords: draft, EARS, source-linked
EARS_Pattern: Ubiquitous

#### 4.3.3 [#66] Threshold value for brake pressure
The cruise control controller shall use brake_threshold (5) as the brake-pressure disable threshold.
Rationale: EARS rewrite of source requirement #66; technical intent requires engineering review before approval.
Keywords: draft, EARS, source-linked
EARS_Pattern: Ubiquitous

#### 4.3.4 [#67] Maximum Throttle Value
The cruise control controller shall use throt_max (100) as the maximum throttle command.
Rationale: EARS rewrite of source requirement #67; technical intent requires engineering review before approval.
Keywords: draft, EARS, source-linked
EARS_Pattern: Ubiquitous

#### 4.3.5 [#68] Minimum Throttle Value
The cruise control controller shall use throt_min (0) as the minimum throttle command.
Rationale: EARS rewrite of source requirement #68; technical intent requires engineering review before approval.
Keywords: draft, EARS, source-linked
EARS_Pattern: Ubiquitous

#### 4.3.6 [#69] Maximum Target Speed
The cruise control controller shall use tsp_max (100) as the maximum target speed.
Rationale: EARS rewrite of source requirement #69; technical intent requires engineering review before approval.
Keywords: draft, EARS, source-linked
EARS_Pattern: Ubiquitous

#### 4.3.7 [#70] Minimum Target Speed
The cruise control controller shall use tsp_min (40) as the minimum target speed.
Rationale: EARS rewrite of source requirement #70; technical intent requires engineering review before approval.
Keywords: draft, EARS, source-linked
EARS_Pattern: Ubiquitous