test file "DriverSwRequest_Tests"

suite "Unit test for DriverSwRequest"

  case "Enable button" [simulation]
    model crs_controller, harness DriverSwRequest_UnitTestHarness (for crs_controller/DriverSwRequest)
    signal scenario: Enable (DriverSwRequest_UnitTestHarness/Harness Inputs)
    custom criteria:
      yout = sltest_simout.get('yout');
      compOut = yout.signals(1).values;
      test.verifyTrue(all(compOut))

  case "Cancel button" [simulation]
    model crs_controller, harness DriverSwRequest_UnitTestHarness (for crs_controller/DriverSwRequest)
    signal scenario: Cancel (DriverSwRequest_UnitTestHarness/Harness Inputs)
    custom criteria: same code as in custom criteria of case "Enable button"

  case "Set button" [simulation]
    model crs_controller, harness DriverSwRequest_UnitTestHarness (for crs_controller/DriverSwRequest)
    signal scenario: Set (DriverSwRequest_UnitTestHarness/Harness Inputs)
    custom criteria: same code as in custom criteria of case "Enable button"

  case "Resume button" [simulation]
    model crs_controller, harness DriverSwRequest_UnitTestHarness (for crs_controller/DriverSwRequest)
    signal scenario: Resume (DriverSwRequest_UnitTestHarness/Harness Inputs)
    custom criteria: same code as in custom criteria of case "Enable button"

  case "Increment button short" [simulation]
    model crs_controller, harness DriverSwRequest_UnitTestHarness (for crs_controller/DriverSwRequest)
    signal scenario: ShortInc (DriverSwRequest_UnitTestHarness/Harness Inputs)
    custom criteria: same code as in custom criteria of case "Enable button"

  case "Increment button hold" [simulation]
    model crs_controller, harness DriverSwRequest_UnitTestHarness (for crs_controller/DriverSwRequest)
    signal scenario: LongInc (DriverSwRequest_UnitTestHarness/Harness Inputs)
    custom criteria: same code as in custom criteria of case "Enable button"

  case "Decrement button short" [simulation]
    model crs_controller, harness DriverSwRequest_UnitTestHarness (for crs_controller/DriverSwRequest)
    signal scenario: ShortDec (DriverSwRequest_UnitTestHarness/Harness Inputs)
    custom criteria: same code as in custom criteria of case "Enable button"

  case "Decrement button hold" [simulation]
    model crs_controller, harness DriverSwRequest_UnitTestHarness (for crs_controller/DriverSwRequest)
    signal scenario: LongDec (DriverSwRequest_UnitTestHarness/Harness Inputs)
    custom criteria: same code as in custom criteria of case "Enable button"