test file "crs_controller_mil_sil_equivalence_tests"
  description: MIL versus SIL equivalence tests for crs_controller. Test inputs are reused from the MIL baseline tests.
  coverage: Decision, MCDC, Condition

suite "MIL-SIL Back-to-Back"

  case "REQ_002_switch_precedence" [equivalence]
    description: MIL-SIL back-to-back test reusing input from baseline case REQ_002_switch_precedence.
    simulation 1:
      model crs_controller, harness crs_controller_harness, mode Normal
      input "req_002_switch_precedence_input.mat", mapped to enbl, cncl, set, resume, inc, dec, brakeP, key, gear, throtDrv, vehSp (active)
    simulation 2:
      model crs_controller, harness crs_controller_harness, mode Software-in-the-Loop (SIL)
      input "req_002_switch_precedence_input.mat", mapped to enbl, cncl, set, resume, inc, dec, brakeP, key, gear, throtDrv, vehSp (active)
    equivalence criteria
      reqDrv
      status
      mode
      targetSp
      throtCC
      reqDrv
      status
      mode
      targetSp
      throtCC

  case "REQ_003_avoid_repeating_cancel" [equivalence]
    description: MIL-SIL back-to-back test reusing input from baseline case REQ_003_avoid_repeating_cancel.
    simulation 1:
      model crs_controller, harness crs_controller_harness, mode Normal
      input "req_003_avoid_repeating_cancel_input.mat", mapped to enbl, cncl, set, resume, inc, dec, brakeP, key, gear, throtDrv, vehSp (active)
    simulation 2:
      model crs_controller, harness crs_controller_harness, mode Software-in-the-Loop (SIL)
      input "req_003_avoid_repeating_cancel_input.mat", mapped to enbl, cncl, set, resume, inc, dec, brakeP, key, gear, throtDrv, vehSp (active)
    equivalence criteria
      reqDrv
      status
      mode
      targetSp
      throtCC
      reqDrv
      status
      mode
      targetSp
      throtCC

  case "REQ_004_long_switch_recognition" [equivalence]
    description: MIL-SIL back-to-back test reusing input from baseline case REQ_004_long_switch_recognition.
    simulation 1:
      model crs_controller, harness crs_controller_harness, mode Normal
      input "req_004_long_switch_recognition_input.mat", mapped to enbl, cncl, set, resume, inc, dec, brakeP, key, gear, throtDrv, vehSp (active)
    simulation 2:
      model crs_controller, harness crs_controller_harness, mode Software-in-the-Loop (SIL)
      input "req_004_long_switch_recognition_input.mat", mapped to enbl, cncl, set, resume, inc, dec, brakeP, key, gear, throtDrv, vehSp (active)
    equivalence criteria
      reqDrv
      status
      mode
      targetSp
      throtCC
      reqDrv
      status
      mode
      targetSp
      throtCC

  case "REQ_005_increment_waiting_state" [equivalence]
    description: MIL-SIL back-to-back test reusing input from baseline case REQ_005_increment_waiting_state.
    simulation 1:
      model crs_controller, harness crs_controller_harness, mode Normal
      input "req_005_increment_waiting_state_input.mat", mapped to enbl, cncl, set, resume, inc, dec, brakeP, key, gear, throtDrv, vehSp (active)
    simulation 2:
      model crs_controller, harness crs_controller_harness, mode Software-in-the-Loop (SIL)
      input "req_005_increment_waiting_state_input.mat", mapped to enbl, cncl, set, resume, inc, dec, brakeP, key, gear, throtDrv, vehSp (active)
    equivalence criteria
      reqDrv
      status
      mode
      targetSp
      throtCC
      reqDrv
      status
      mode
      targetSp
      throtCC

  case "REQ_006_decrement_waiting_state" [equivalence]
    description: MIL-SIL back-to-back test reusing input from baseline case REQ_006_decrement_waiting_state.
    simulation 1:
      model crs_controller, harness crs_controller_harness, mode Normal
      input "req_006_decrement_waiting_state_input.mat", mapped to enbl, cncl, set, resume, inc, dec, brakeP, key, gear, throtDrv, vehSp (active)
    simulation 2:
      model crs_controller, harness crs_controller_harness, mode Software-in-the-Loop (SIL)
      input "req_006_decrement_waiting_state_input.mat", mapped to enbl, cncl, set, resume, inc, dec, brakeP, key, gear, throtDrv, vehSp (active)
    equivalence criteria
      reqDrv
      status
      mode
      targetSp
      throtCC
      reqDrv
      status
      mode
      targetSp
      throtCC

  case "REQ_007_cancel_switch" [equivalence]
    description: MIL-SIL back-to-back test reusing input from baseline case REQ_007_cancel_switch.
    simulation 1:
      model crs_controller, harness crs_controller_harness, mode Normal
      input "req_007_cancel_switch_input.mat", mapped to enbl, cncl, set, resume, inc, dec, brakeP, key, gear, throtDrv, vehSp (active)
    simulation 2:
      model crs_controller, harness crs_controller_harness, mode Software-in-the-Loop (SIL)
      input "req_007_cancel_switch_input.mat", mapped to enbl, cncl, set, resume, inc, dec, brakeP, key, gear, throtDrv, vehSp (active)
    equivalence criteria
      reqDrv
      status
      mode
      targetSp
      throtCC
      reqDrv
      status
      mode
      targetSp
      throtCC

  case "REQ_008_set_switch" [equivalence]
    description: MIL-SIL back-to-back test reusing input from baseline case REQ_008_set_switch.
    simulation 1:
      model crs_controller, harness crs_controller_harness, mode Normal
      input "req_008_set_switch_input.mat", mapped to enbl, cncl, set, resume, inc, dec, brakeP, key, gear, throtDrv, vehSp (active)
    simulation 2:
      model crs_controller, harness crs_controller_harness, mode Software-in-the-Loop (SIL)
      input "req_008_set_switch_input.mat", mapped to enbl, cncl, set, resume, inc, dec, brakeP, key, gear, throtDrv, vehSp (active)
    equivalence criteria
      reqDrv
      status
      mode
      targetSp
      throtCC
      reqDrv
      status
      mode
      targetSp
      throtCC

  case "REQ_009_enable_switch" [equivalence]
    description: MIL-SIL back-to-back test reusing input from baseline case REQ_009_enable_switch.
    simulation 1:
      model crs_controller, harness crs_controller_harness, mode Normal
      input "req_009_enable_switch_input.mat", mapped to enbl, cncl, set, resume, inc, dec, brakeP, key, gear, throtDrv, vehSp (active)
    simulation 2:
      model crs_controller, harness crs_controller_harness, mode Software-in-the-Loop (SIL)
      input "req_009_enable_switch_input.mat", mapped to enbl, cncl, set, resume, inc, dec, brakeP, key, gear, throtDrv, vehSp (active)
    equivalence criteria
      reqDrv
      status
      mode
      targetSp
      throtCC
      reqDrv
      status
      mode
      targetSp
      throtCC

  case "REQ_011_increment_duration_classes" [equivalence]
    description: MIL-SIL back-to-back test reusing input from baseline case REQ_011_increment_duration_classes.
    simulation 1:
      model crs_controller, harness crs_controller_harness, mode Normal
      input "req_011_increment_duration_classes_input.mat", mapped to enbl, cncl, set, resume, inc, dec, brakeP, key, gear, throtDrv, vehSp (active)
    simulation 2:
      model crs_controller, harness crs_controller_harness, mode Software-in-the-Loop (SIL)
      input "req_011_increment_duration_classes_input.mat", mapped to enbl, cncl, set, resume, inc, dec, brakeP, key, gear, throtDrv, vehSp (active)
    equivalence criteria
      reqDrv
      status
      mode
      targetSp
      throtCC
      reqDrv
      status
      mode
      targetSp
      throtCC

  case "REQ_012_increment_short_on_release" [equivalence]
    description: MIL-SIL back-to-back test reusing input from baseline case REQ_012_increment_short_on_release.
    simulation 1:
      model crs_controller, harness crs_controller_harness, mode Normal
      input "req_012_increment_short_on_release_input.mat", mapped to enbl, cncl, set, resume, inc, dec, brakeP, key, gear, throtDrv, vehSp (active)
    simulation 2:
      model crs_controller, harness crs_controller_harness, mode Software-in-the-Loop (SIL)
      input "req_012_increment_short_on_release_input.mat", mapped to enbl, cncl, set, resume, inc, dec, brakeP, key, gear, throtDrv, vehSp (active)
    equivalence criteria
      reqDrv
      status
      mode
      targetSp
      throtCC
      reqDrv
      status
      mode
      targetSp
      throtCC

  case "REQ_013_increment_long" [equivalence]
    description: MIL-SIL back-to-back test reusing input from baseline case REQ_013_increment_long.
    simulation 1:
      model crs_controller, harness crs_controller_harness, mode Normal
      input "req_013_increment_long_input.mat", mapped to enbl, cncl, set, resume, inc, dec, brakeP, key, gear, throtDrv, vehSp (active)
    simulation 2:
      model crs_controller, harness crs_controller_harness, mode Software-in-the-Loop (SIL)
      input "req_013_increment_long_input.mat", mapped to enbl, cncl, set, resume, inc, dec, brakeP, key, gear, throtDrv, vehSp (active)
    equivalence criteria
      reqDrv
      status
      mode
      targetSp
      throtCC
      reqDrv
      status
      mode
      targetSp
      throtCC

  case "REQ_014_increment_middle" [equivalence]
    description: MIL-SIL back-to-back test reusing input from baseline case REQ_014_increment_middle.
    simulation 1:
      model crs_controller, harness crs_controller_harness, mode Normal
      input "req_014_increment_middle_input.mat", mapped to enbl, cncl, set, resume, inc, dec, brakeP, key, gear, throtDrv, vehSp (active)
    simulation 2:
      model crs_controller, harness crs_controller_harness, mode Software-in-the-Loop (SIL)
      input "req_014_increment_middle_input.mat", mapped to enbl, cncl, set, resume, inc, dec, brakeP, key, gear, throtDrv, vehSp (active)
    equivalence criteria
      reqDrv
      status
      mode
      targetSp
      throtCC
      reqDrv
      status
      mode
      targetSp
      throtCC

  case "REQ_015_decrement_duration_classes" [equivalence]
    description: MIL-SIL back-to-back test reusing input from baseline case REQ_015_decrement_duration_classes.
    simulation 1:
      model crs_controller, harness crs_controller_harness, mode Normal
      input "req_015_decrement_duration_classes_input.mat", mapped to enbl, cncl, set, resume, inc, dec, brakeP, key, gear, throtDrv, vehSp (active)
    simulation 2:
      model crs_controller, harness crs_controller_harness, mode Software-in-the-Loop (SIL)
      input "req_015_decrement_duration_classes_input.mat", mapped to enbl, cncl, set, resume, inc, dec, brakeP, key, gear, throtDrv, vehSp (active)
    equivalence criteria
      reqDrv
      status
      mode
      targetSp
      throtCC
      reqDrv
      status
      mode
      targetSp
      throtCC

  case "REQ_016_decrement_short_on_release" [equivalence]
    description: MIL-SIL back-to-back test reusing input from baseline case REQ_016_decrement_short_on_release.
    simulation 1:
      model crs_controller, harness crs_controller_harness, mode Normal
      input "req_016_decrement_short_on_release_input.mat", mapped to enbl, cncl, set, resume, inc, dec, brakeP, key, gear, throtDrv, vehSp (active)
    simulation 2:
      model crs_controller, harness crs_controller_harness, mode Software-in-the-Loop (SIL)
      input "req_016_decrement_short_on_release_input.mat", mapped to enbl, cncl, set, resume, inc, dec, brakeP, key, gear, throtDrv, vehSp (active)
    equivalence criteria
      reqDrv
      status
      mode
      targetSp
      throtCC
      reqDrv
      status
      mode
      targetSp
      throtCC

  case "REQ_017_decrement_long" [equivalence]
    description: MIL-SIL back-to-back test reusing input from baseline case REQ_017_decrement_long.
    simulation 1:
      model crs_controller, harness crs_controller_harness, mode Normal
      input "req_017_decrement_long_input.mat", mapped to enbl, cncl, set, resume, inc, dec, brakeP, key, gear, throtDrv, vehSp (active)
    simulation 2:
      model crs_controller, harness crs_controller_harness, mode Software-in-the-Loop (SIL)
      input "req_017_decrement_long_input.mat", mapped to enbl, cncl, set, resume, inc, dec, brakeP, key, gear, throtDrv, vehSp (active)
    equivalence criteria
      reqDrv
      status
      mode
      targetSp
      throtCC
      reqDrv
      status
      mode
      targetSp
      throtCC

  case "REQ_018_decrement_middle" [equivalence]
    description: MIL-SIL back-to-back test reusing input from baseline case REQ_018_decrement_middle.
    simulation 1:
      model crs_controller, harness crs_controller_harness, mode Normal
      input "req_018_decrement_middle_input.mat", mapped to enbl, cncl, set, resume, inc, dec, brakeP, key, gear, throtDrv, vehSp (active)
    simulation 2:
      model crs_controller, harness crs_controller_harness, mode Software-in-the-Loop (SIL)
      input "req_018_decrement_middle_input.mat", mapped to enbl, cncl, set, resume, inc, dec, brakeP, key, gear, throtDrv, vehSp (active)
    equivalence criteria
      reqDrv
      status
      mode
      targetSp
      throtCC
      reqDrv
      status
      mode
      targetSp
      throtCC

  case "REQ_020_any_disable_condition" [equivalence]
    description: MIL-SIL back-to-back test reusing input from baseline case REQ_020_any_disable_condition.
    simulation 1:
      model crs_controller, harness crs_controller_harness, mode Normal
      input "req_020_any_disable_condition_input.mat", mapped to enbl, cncl, set, resume, inc, dec, brakeP, key, gear, throtDrv, vehSp (active)
    simulation 2:
      model crs_controller, harness crs_controller_harness, mode Software-in-the-Loop (SIL)
      input "req_020_any_disable_condition_input.mat", mapped to enbl, cncl, set, resume, inc, dec, brakeP, key, gear, throtDrv, vehSp (active)
    equivalence criteria
      reqDrv
      status
      mode
      targetSp
      throtCC
      reqDrv
      status
      mode
      targetSp
      throtCC

  case "REQ_021_key_not_on" [equivalence]
    description: MIL-SIL back-to-back test reusing input from baseline case REQ_021_key_not_on.
    simulation 1:
      model crs_controller, harness crs_controller_harness, mode Normal
      input "req_021_key_not_on_input.mat", mapped to enbl, cncl, set, resume, inc, dec, brakeP, key, gear, throtDrv, vehSp (active)
    simulation 2:
      model crs_controller, harness crs_controller_harness, mode Software-in-the-Loop (SIL)
      input "req_021_key_not_on_input.mat", mapped to enbl, cncl, set, resume, inc, dec, brakeP, key, gear, throtDrv, vehSp (active)
    equivalence criteria
      reqDrv
      status
      mode
      targetSp
      throtCC
      reqDrv
      status
      mode
      targetSp
      throtCC

  case "REQ_022_gear_not_drive" [equivalence]
    description: MIL-SIL back-to-back test reusing input from baseline case REQ_022_gear_not_drive.
    simulation 1:
      model crs_controller, harness crs_controller_harness, mode Normal
      input "req_022_gear_not_drive_input.mat", mapped to enbl, cncl, set, resume, inc, dec, brakeP, key, gear, throtDrv, vehSp (active)
    simulation 2:
      model crs_controller, harness crs_controller_harness, mode Software-in-the-Loop (SIL)
      input "req_022_gear_not_drive_input.mat", mapped to enbl, cncl, set, resume, inc, dec, brakeP, key, gear, throtDrv, vehSp (active)
    equivalence criteria
      reqDrv
      status
      mode
      targetSp
      throtCC
      reqDrv
      status
      mode
      targetSp
      throtCC

  case "REQ_023_brake_above_threshold" [equivalence]
    description: MIL-SIL back-to-back test reusing input from baseline case REQ_023_brake_above_threshold.
    simulation 1:
      model crs_controller, harness crs_controller_harness, mode Normal
      input "req_023_brake_above_threshold_input.mat", mapped to enbl, cncl, set, resume, inc, dec, brakeP, key, gear, throtDrv, vehSp (active)
    simulation 2:
      model crs_controller, harness crs_controller_harness, mode Software-in-the-Loop (SIL)
      input "req_023_brake_above_threshold_input.mat", mapped to enbl, cncl, set, resume, inc, dec, brakeP, key, gear, throtDrv, vehSp (active)
    equivalence criteria
      reqDrv
      status
      mode
      targetSp
      throtCC
      reqDrv
      status
      mode
      targetSp
      throtCC

  case "REQ_024_operation_mode_determination" [equivalence]
    description: MIL-SIL back-to-back test reusing input from baseline case REQ_024_operation_mode_determination.
    simulation 1:
      model crs_controller, harness crs_controller_harness, mode Normal
      input "req_024_operation_mode_determination_input.mat", mapped to enbl, cncl, set, resume, inc, dec, brakeP, key, gear, throtDrv, vehSp (active)
    simulation 2:
      model crs_controller, harness crs_controller_harness, mode Software-in-the-Loop (SIL)
      input "req_024_operation_mode_determination_input.mat", mapped to enbl, cncl, set, resume, inc, dec, brakeP, key, gear, throtDrv, vehSp (active)
    equivalence criteria
      reqDrv
      status
      mode
      targetSp
      throtCC
      reqDrv
      status
      mode
      targetSp
      throtCC

  case "REQ_025_mode_precedence" [equivalence]
    description: MIL-SIL back-to-back test reusing input from baseline case REQ_025_mode_precedence.
    simulation 1:
      model crs_controller, harness crs_controller_harness, mode Normal
      input "req_025_mode_precedence_input.mat", mapped to enbl, cncl, set, resume, inc, dec, brakeP, key, gear, throtDrv, vehSp (active)
    simulation 2:
      model crs_controller, harness crs_controller_harness, mode Software-in-the-Loop (SIL)
      input "req_025_mode_precedence_input.mat", mapped to enbl, cncl, set, resume, inc, dec, brakeP, key, gear, throtDrv, vehSp (active)
    equivalence criteria
      reqDrv
      status
      mode
      targetSp
      throtCC
      reqDrv
      status
      mode
      targetSp
      throtCC

  case "REQ_026_disable_condition" [equivalence]
    description: MIL-SIL back-to-back test reusing input from baseline case REQ_026_disable_condition.
    simulation 1:
      model crs_controller, harness crs_controller_harness, mode Normal
      input "req_026_disable_condition_input.mat", mapped to enbl, cncl, set, resume, inc, dec, brakeP, key, gear, throtDrv, vehSp (active)
    simulation 2:
      model crs_controller, harness crs_controller_harness, mode Software-in-the-Loop (SIL)
      input "req_026_disable_condition_input.mat", mapped to enbl, cncl, set, resume, inc, dec, brakeP, key, gear, throtDrv, vehSp (active)
    equivalence criteria
      reqDrv
      status
      mode
      targetSp
      throtCC
      reqDrv
      status
      mode
      targetSp
      throtCC

  case "REQ_030_retain_previous_mode" [equivalence]
    description: MIL-SIL back-to-back test reusing input from baseline case REQ_030_retain_previous_mode.
    simulation 1:
      model crs_controller, harness crs_controller_harness, mode Normal
      input "req_030_retain_previous_mode_input.mat", mapped to enbl, cncl, set, resume, inc, dec, brakeP, key, gear, throtDrv, vehSp (active)
    simulation 2:
      model crs_controller, harness crs_controller_harness, mode Software-in-the-Loop (SIL)
      input "req_030_retain_previous_mode_input.mat", mapped to enbl, cncl, set, resume, inc, dec, brakeP, key, gear, throtDrv, vehSp (active)
    equivalence criteria
      reqDrv
      status
      mode
      targetSp
      throtCC
      reqDrv
      status
      mode
      targetSp
      throtCC

  case "REQ_036_disable_override" [equivalence]
    description: MIL-SIL back-to-back test reusing input from baseline case REQ_036_disable_override.
    simulation 1:
      model crs_controller, harness crs_controller_harness, mode Normal
      input "req_036_disable_override_input.mat", mapped to enbl, cncl, set, resume, inc, dec, brakeP, key, gear, throtDrv, vehSp (active)
    simulation 2:
      model crs_controller, harness crs_controller_harness, mode Software-in-the-Loop (SIL)
      input "req_036_disable_override_input.mat", mapped to enbl, cncl, set, resume, inc, dec, brakeP, key, gear, throtDrv, vehSp (active)
    equivalence criteria
      reqDrv
      status
      mode
      targetSp
      throtCC
      reqDrv
      status
      mode
      targetSp
      throtCC

  case "REQ_038_disabled_outputs" [equivalence]
    description: MIL-SIL back-to-back test reusing input from baseline case REQ_038_disabled_outputs.
    simulation 1:
      model crs_controller, harness crs_controller_harness, mode Normal
      input "req_038_disabled_outputs_input.mat", mapped to enbl, cncl, set, resume, inc, dec, brakeP, key, gear, throtDrv, vehSp (active)
    simulation 2:
      model crs_controller, harness crs_controller_harness, mode Software-in-the-Loop (SIL)
      input "req_038_disabled_outputs_input.mat", mapped to enbl, cncl, set, resume, inc, dec, brakeP, key, gear, throtDrv, vehSp (active)
    equivalence criteria
      reqDrv
      status
      mode
      targetSp
      throtCC
      reqDrv
      status
      mode
      targetSp
      throtCC

  case "REQ_039_enabled_outputs" [equivalence]
    description: MIL-SIL back-to-back test reusing input from baseline case REQ_039_enabled_outputs.
    simulation 1:
      model crs_controller, harness crs_controller_harness, mode Normal
      input "req_039_enabled_outputs_input.mat", mapped to enbl, cncl, set, resume, inc, dec, brakeP, key, gear, throtDrv, vehSp (active)
    simulation 2:
      model crs_controller, harness crs_controller_harness, mode Software-in-the-Loop (SIL)
      input "req_039_enabled_outputs_input.mat", mapped to enbl, cncl, set, resume, inc, dec, brakeP, key, gear, throtDrv, vehSp (active)
    equivalence criteria
      reqDrv
      status
      mode
      targetSp
      throtCC
      reqDrv
      status
      mode
      targetSp
      throtCC

  case "SLDV_MCDC_Coverage" [equivalence]
    description: SLDV-generated test that satisfies all model Decision, Condition, and MC/DC objectives. Signal range diagnostics are warnings because the test intentionally exercises out-of-range branches.
    simulation 1:
      model crs_controller, harness crs_controller_harness, mode Normal
      input "crs_controller_sldv_input.mat", mapped to enbl, cncl, set, resume, inc, dec, brakeP, key, gear, throtDrv, vehSp (active)
      pre-load callback:
        set_param('crs_controller','SignalRangeChecking','warning');set_param('crs_controller_harness','SignalRangeChecking','warning');
    simulation 2:
      model crs_controller, harness crs_controller_harness, mode Software-in-the-Loop (SIL)
      input "crs_controller_sldv_input.mat", mapped to enbl, cncl, set, resume, inc, dec, brakeP, key, gear, throtDrv, vehSp (active)
    equivalence criteria
      reqDrv
      status
      mode
      targetSp
      throtCC
      reqDrv
      status
      mode
      targetSp
      throtCC

  case "SIL_Cruise_While_Enabled" [equivalence]
    description: Targeted generated-code MC/DC coverage test.
    simulation 1:
      model crs_controller, harness crs_controller_harness, mode Normal
      input "sil_cruise_while_enabled_input.mat", mapped to enbl, cncl, set, resume, inc, dec, brakeP, key, gear, throtDrv, vehSp (active)
      pre-load callback: same code as in pre-load callback of case "SLDV_MCDC_Coverage"
    simulation 2:
      model crs_controller, harness crs_controller_harness, mode Software-in-the-Loop (SIL)
      input "sil_cruise_while_enabled_input.mat", mapped to enbl, cncl, set, resume, inc, dec, brakeP, key, gear, throtDrv, vehSp (active)
    equivalence criteria
      reqDrv
      status
      mode
      targetSp
      throtCC
      reqDrv
      status
      mode
      targetSp
      throtCC

  case "SIL_Cancel_From_Increment" [equivalence]
    description: Targeted generated-code MC/DC coverage test.
    simulation 1:
      model crs_controller, harness crs_controller_harness, mode Normal
      input "sil_cancel_from_increment_input.mat", mapped to enbl, cncl, set, resume, inc, dec, brakeP, key, gear, throtDrv, vehSp (active)
      pre-load callback: same code as in pre-load callback of case "SLDV_MCDC_Coverage"
    simulation 2:
      model crs_controller, harness crs_controller_harness, mode Software-in-the-Loop (SIL)
      input "sil_cancel_from_increment_input.mat", mapped to enbl, cncl, set, resume, inc, dec, brakeP, key, gear, throtDrv, vehSp (active)
    equivalence criteria
      reqDrv
      status
      mode
      targetSp
      throtCC
      reqDrv
      status
      mode
      targetSp
      throtCC

  case "SIL_Cancel_From_Decrement" [equivalence]
    description: Targeted generated-code MC/DC coverage test.
    simulation 1:
      model crs_controller, harness crs_controller_harness, mode Normal
      input "sil_cancel_from_decrement_input.mat", mapped to enbl, cncl, set, resume, inc, dec, brakeP, key, gear, throtDrv, vehSp (active)
      pre-load callback: same code as in pre-load callback of case "SLDV_MCDC_Coverage"
    simulation 2:
      model crs_controller, harness crs_controller_harness, mode Software-in-the-Loop (SIL)
      input "sil_cancel_from_decrement_input.mat", mapped to enbl, cncl, set, resume, inc, dec, brakeP, key, gear, throtDrv, vehSp (active)
    equivalence criteria
      reqDrv
      status
      mode
      targetSp
      throtCC
      reqDrv
      status
      mode
      targetSp
      throtCC

  case "SIL_Cancel_From_Resume" [equivalence]
    description: Targeted generated-code MC/DC coverage test.
    simulation 1:
      model crs_controller, harness crs_controller_harness, mode Normal
      input "sil_cancel_from_resume_input.mat", mapped to enbl, cncl, set, resume, inc, dec, brakeP, key, gear, throtDrv, vehSp (active)
      pre-load callback: same code as in pre-load callback of case "SLDV_MCDC_Coverage"
    simulation 2:
      model crs_controller, harness crs_controller_harness, mode Software-in-the-Loop (SIL)
      input "sil_cancel_from_resume_input.mat", mapped to enbl, cncl, set, resume, inc, dec, brakeP, key, gear, throtDrv, vehSp (active)
    equivalence criteria
      reqDrv
      status
      mode
      targetSp
      throtCC
      reqDrv
      status
      mode
      targetSp
      throtCC

  case "SIL_IncrementHold_And_HighSpeed" [equivalence]
    description: Targeted generated-code MC/DC coverage test.
    simulation 1:
      model crs_controller, harness crs_controller_harness, mode Normal
      input "sil_incrementhold_and_highspeed_input.mat", mapped to enbl, cncl, set, resume, inc, dec, brakeP, key, gear, throtDrv, vehSp (active)
      pre-load callback: same code as in pre-load callback of case "SLDV_MCDC_Coverage"
    simulation 2:
      model crs_controller, harness crs_controller_harness, mode Software-in-the-Loop (SIL)
      input "sil_incrementhold_and_highspeed_input.mat", mapped to enbl, cncl, set, resume, inc, dec, brakeP, key, gear, throtDrv, vehSp (active)
    equivalence criteria
      reqDrv
      status
      mode
      targetSp
      throtCC
      reqDrv
      status
      mode
      targetSp
      throtCC