test file "crs_controller_requirements_MIL"
  description: Requirements-based MIL baseline tests for crs_controller. Inputs and expected baselines are authored from EARS requirements.
  coverage: Decision, MCDC, Condition

suite "EARS Requirements MIL"
  description: One baseline test per *_input.mat file discovered in C:\AgenticAI\projects\MAC_ModelVnV\CruiseRequirementsExample\tests\test_case.

  case "REQ_002_switch_precedence" [baseline]
    description: Requirement-derived MIL test using req_002_switch_precedence_input.mat and req_002_switch_precedence_baseline.mat.
    model crs_controller, harness crs_controller_harness, mode Normal
    input "req_002_switch_precedence_input.mat", mapped to enbl, cncl, set, resume, inc, dec, brakeP, key, gear, throtDrv, vehSp (active)
    logged signals "RequirementOracleSignals": reqDrv, status, mode, targetSp, throtCC
    baseline "req_002_switch_precedence_baseline.mat" (0 of 1 signals compared)
    custom criteria:
      yout = sltest_simout.get('yout');
      isDataset = isa(yout,'Simulink.SimulationData.Dataset');
      signalName = "reqDrv";
      if isDataset
          signalElement = yout.getElement(signalName);
          actual = signalElement.Values;
      else
          labels = string({yout.signals.label});
          signalPosition = find(labels == signalName,1);
          actual = timeseries(yout.signals(signalPosition).values,yout.time);
      end
      expectedTime = 0.01;
      expectedData = 1;
      sampled = resample(actual,expectedTime,'zoh');
      test.verifyEqual(double(sampled.Data(:)),expectedData(:), ...
          sprintf('%s differs at an authored assessment time.',signalName));

  case "REQ_003_avoid_repeating_cancel" [baseline]
    description: Requirement-derived MIL test using req_003_avoid_repeating_cancel_input.mat and req_003_avoid_repeating_cancel_baseline.mat.
    model crs_controller, harness crs_controller_harness, mode Normal
    input "req_003_avoid_repeating_cancel_input.mat", mapped to enbl, cncl, set, resume, inc, dec, brakeP, key, gear, throtDrv, vehSp (active)
    logged signals "RequirementOracleSignals": reqDrv, status, mode, targetSp, throtCC
    baseline "req_003_avoid_repeating_cancel_baseline.mat" (0 of 1 signals compared)
    custom criteria:
      yout = sltest_simout.get('yout');
      isDataset = isa(yout,'Simulink.SimulationData.Dataset');
      signalName = "reqDrv";
      if isDataset
          signalElement = yout.getElement(signalName);
          actual = signalElement.Values;
      else
          labels = string({yout.signals.label});
          signalPosition = find(labels == signalName,1);
          actual = timeseries(yout.signals(signalPosition).values,yout.time);
      end
      expectedTime = [0.01;0.02];
      expectedData = [1;0];
      sampled = resample(actual,expectedTime,'zoh');
      test.verifyEqual(double(sampled.Data(:)),expectedData(:), ...
          sprintf('%s differs at an authored assessment time.',signalName));

  case "REQ_004_long_switch_recognition" [baseline]
    description: Requirement-derived MIL test using req_004_long_switch_recognition_input.mat and req_004_long_switch_recognition_baseline.mat.
    model crs_controller, harness crs_controller_harness, mode Normal
    input "req_004_long_switch_recognition_input.mat", mapped to enbl, cncl, set, resume, inc, dec, brakeP, key, gear, throtDrv, vehSp (active)
    logged signals "RequirementOracleSignals": reqDrv, status, mode, targetSp, throtCC
    baseline "req_004_long_switch_recognition_baseline.mat" (0 of 1 signals compared)
    custom criteria:
      yout = sltest_simout.get('yout');
      isDataset = isa(yout,'Simulink.SimulationData.Dataset');
      signalName = "reqDrv";
      if isDataset
          signalElement = yout.getElement(signalName);
          actual = signalElement.Values;
      else
          labels = string({yout.signals.label});
          signalPosition = find(labels == signalName,1);
          actual = timeseries(yout.signals(signalPosition).values,yout.time);
      end
      expectedTime = [0.51000000000000001;1.0900000000000001];
      expectedData = [7;10];
      sampled = resample(actual,expectedTime,'zoh');
      test.verifyEqual(double(sampled.Data(:)),expectedData(:), ...
          sprintf('%s differs at an authored assessment time.',signalName));

  case "REQ_005_increment_waiting_state" [baseline]
    description: Requirement-derived MIL test using req_005_increment_waiting_state_input.mat and req_005_increment_waiting_state_baseline.mat.
    model crs_controller, harness crs_controller_harness, mode Normal
    input "req_005_increment_waiting_state_input.mat", mapped to enbl, cncl, set, resume, inc, dec, brakeP, key, gear, throtDrv, vehSp (active)
    logged signals "RequirementOracleSignals": reqDrv, status, mode, targetSp, throtCC
    baseline "req_005_increment_waiting_state_baseline.mat" (0 of 1 signals compared)
    custom criteria:
      yout = sltest_simout.get('yout');
      isDataset = isa(yout,'Simulink.SimulationData.Dataset');
      signalName = "reqDrv";
      if isDataset
          signalElement = yout.getElement(signalName);
          actual = signalElement.Values;
      else
          labels = string({yout.signals.label});
          signalPosition = find(labels == signalName,1);
          actual = timeseries(yout.signals(signalPosition).values,yout.time);
      end
      expectedTime = 0.25;
      expectedData = 6;
      sampled = resample(actual,expectedTime,'zoh');
      test.verifyEqual(double(sampled.Data(:)),expectedData(:), ...
          sprintf('%s differs at an authored assessment time.',signalName));

  case "REQ_006_decrement_waiting_state" [baseline]
    description: Requirement-derived MIL test using req_006_decrement_waiting_state_input.mat and req_006_decrement_waiting_state_baseline.mat.
    model crs_controller, harness crs_controller_harness, mode Normal
    input "req_006_decrement_waiting_state_input.mat", mapped to enbl, cncl, set, resume, inc, dec, brakeP, key, gear, throtDrv, vehSp (active)
    logged signals "RequirementOracleSignals": reqDrv, status, mode, targetSp, throtCC
    baseline "req_006_decrement_waiting_state_baseline.mat" (0 of 1 signals compared)
    custom criteria:
      yout = sltest_simout.get('yout');
      isDataset = isa(yout,'Simulink.SimulationData.Dataset');
      signalName = "reqDrv";
      if isDataset
          signalElement = yout.getElement(signalName);
          actual = signalElement.Values;
      else
          labels = string({yout.signals.label});
          signalPosition = find(labels == signalName,1);
          actual = timeseries(yout.signals(signalPosition).values,yout.time);
      end
      expectedTime = 0.25;
      expectedData = 9;
      sampled = resample(actual,expectedTime,'zoh');
      test.verifyEqual(double(sampled.Data(:)),expectedData(:), ...
          sprintf('%s differs at an authored assessment time.',signalName));

  case "REQ_007_cancel_switch" [baseline]
    description: Requirement-derived MIL test using req_007_cancel_switch_input.mat and req_007_cancel_switch_baseline.mat.
    model crs_controller, harness crs_controller_harness, mode Normal
    input "req_007_cancel_switch_input.mat", mapped to enbl, cncl, set, resume, inc, dec, brakeP, key, gear, throtDrv, vehSp (active)
    logged signals "RequirementOracleSignals": reqDrv, status, mode, targetSp, throtCC
    baseline "req_007_cancel_switch_baseline.mat" (0 of 1 signals compared)
    custom criteria: same code as in custom criteria of case "REQ_002_switch_precedence"

  case "REQ_008_set_switch" [baseline]
    description: Requirement-derived MIL test using req_008_set_switch_input.mat and req_008_set_switch_baseline.mat.
    model crs_controller, harness crs_controller_harness, mode Normal
    input "req_008_set_switch_input.mat", mapped to enbl, cncl, set, resume, inc, dec, brakeP, key, gear, throtDrv, vehSp (active)
    logged signals "RequirementOracleSignals": reqDrv, status, mode, targetSp, throtCC
    baseline "req_008_set_switch_baseline.mat" (0 of 1 signals compared)
    custom criteria:
      yout = sltest_simout.get('yout');
      isDataset = isa(yout,'Simulink.SimulationData.Dataset');
      signalName = "reqDrv";
      if isDataset
          signalElement = yout.getElement(signalName);
          actual = signalElement.Values;
      else
          labels = string({yout.signals.label});
          signalPosition = find(labels == signalName,1);
          actual = timeseries(yout.signals(signalPosition).values,yout.time);
      end
      expectedTime = 0.01;
      expectedData = 3;
      sampled = resample(actual,expectedTime,'zoh');
      test.verifyEqual(double(sampled.Data(:)),expectedData(:), ...
          sprintf('%s differs at an authored assessment time.',signalName));

  case "REQ_009_enable_switch" [baseline]
    description: Requirement-derived MIL test using req_009_enable_switch_input.mat and req_009_enable_switch_baseline.mat.
    model crs_controller, harness crs_controller_harness, mode Normal
    input "req_009_enable_switch_input.mat", mapped to enbl, cncl, set, resume, inc, dec, brakeP, key, gear, throtDrv, vehSp (active)
    logged signals "RequirementOracleSignals": reqDrv, status, mode, targetSp, throtCC
    baseline "req_009_enable_switch_baseline.mat" (0 of 1 signals compared)
    custom criteria:
      yout = sltest_simout.get('yout');
      isDataset = isa(yout,'Simulink.SimulationData.Dataset');
      signalName = "reqDrv";
      if isDataset
          signalElement = yout.getElement(signalName);
          actual = signalElement.Values;
      else
          labels = string({yout.signals.label});
          signalPosition = find(labels == signalName,1);
          actual = timeseries(yout.signals(signalPosition).values,yout.time);
      end
      expectedTime = 0.01;
      expectedData = 2;
      sampled = resample(actual,expectedTime,'zoh');
      test.verifyEqual(double(sampled.Data(:)),expectedData(:), ...
          sprintf('%s differs at an authored assessment time.',signalName));

  case "REQ_011_increment_duration_classes" [baseline]
    description: Requirement-derived MIL test using req_011_increment_duration_classes_input.mat and req_011_increment_duration_classes_baseline.mat.
    model crs_controller, harness crs_controller_harness, mode Normal
    input "req_011_increment_duration_classes_input.mat", mapped to enbl, cncl, set, resume, inc, dec, brakeP, key, gear, throtDrv, vehSp (active)
    logged signals "RequirementOracleSignals": reqDrv, status, mode, targetSp, throtCC
    baseline "req_011_increment_duration_classes_baseline.mat" (0 of 1 signals compared)
    custom criteria:
      yout = sltest_simout.get('yout');
      isDataset = isa(yout,'Simulink.SimulationData.Dataset');
      signalName = "reqDrv";
      if isDataset
          signalElement = yout.getElement(signalName);
          actual = signalElement.Values;
      else
          labels = string({yout.signals.label});
          signalPosition = find(labels == signalName,1);
          actual = timeseries(yout.signals(signalPosition).values,yout.time);
      end
      expectedTime = [0.01;0.02;0.51000000000000001];
      expectedData = [5;6;7];
      sampled = resample(actual,expectedTime,'zoh');
      test.verifyEqual(double(sampled.Data(:)),expectedData(:), ...
          sprintf('%s differs at an authored assessment time.',signalName));

  case "REQ_012_increment_short_on_release" [baseline]
    description: Requirement-derived MIL test using req_012_increment_short_on_release_input.mat and req_012_increment_short_on_release_baseline.mat.
    model crs_controller, harness crs_controller_harness, mode Normal
    input "req_012_increment_short_on_release_input.mat", mapped to enbl, cncl, set, resume, inc, dec, brakeP, key, gear, throtDrv, vehSp (active)
    logged signals "RequirementOracleSignals": reqDrv, status, mode, targetSp, throtCC
    baseline "req_012_increment_short_on_release_baseline.mat" (0 of 1 signals compared)
    custom criteria:
      yout = sltest_simout.get('yout');
      isDataset = isa(yout,'Simulink.SimulationData.Dataset');
      signalName = "reqDrv";
      if isDataset
          signalElement = yout.getElement(signalName);
          actual = signalElement.Values;
      else
          labels = string({yout.signals.label});
          signalPosition = find(labels == signalName,1);
          actual = timeseries(yout.signals(signalPosition).values,yout.time);
      end
      expectedTime = 0.02;
      expectedData = 5;
      sampled = resample(actual,expectedTime,'zoh');
      test.verifyEqual(double(sampled.Data(:)),expectedData(:), ...
          sprintf('%s differs at an authored assessment time.',signalName));

  case "REQ_013_increment_long" [baseline]
    description: Requirement-derived MIL test using req_013_increment_long_input.mat and req_013_increment_long_baseline.mat.
    model crs_controller, harness crs_controller_harness, mode Normal
    input "req_013_increment_long_input.mat", mapped to enbl, cncl, set, resume, inc, dec, brakeP, key, gear, throtDrv, vehSp (active)
    logged signals "RequirementOracleSignals": reqDrv, status, mode, targetSp, throtCC
    baseline "req_013_increment_long_baseline.mat" (0 of 1 signals compared)
    custom criteria:
      yout = sltest_simout.get('yout');
      isDataset = isa(yout,'Simulink.SimulationData.Dataset');
      signalName = "reqDrv";
      if isDataset
          signalElement = yout.getElement(signalName);
          actual = signalElement.Values;
      else
          labels = string({yout.signals.label});
          signalPosition = find(labels == signalName,1);
          actual = timeseries(yout.signals(signalPosition).values,yout.time);
      end
      expectedTime = 0.51000000000000001;
      expectedData = 7;
      sampled = resample(actual,expectedTime,'zoh');
      test.verifyEqual(double(sampled.Data(:)),expectedData(:), ...
          sprintf('%s differs at an authored assessment time.',signalName));

  case "REQ_014_increment_middle" [baseline]
    description: Requirement-derived MIL test using req_014_increment_middle_input.mat and req_014_increment_middle_baseline.mat.
    model crs_controller, harness crs_controller_harness, mode Normal
    input "req_014_increment_middle_input.mat", mapped to enbl, cncl, set, resume, inc, dec, brakeP, key, gear, throtDrv, vehSp (active)
    logged signals "RequirementOracleSignals": reqDrv, status, mode, targetSp, throtCC
    baseline "req_014_increment_middle_baseline.mat" (0 of 1 signals compared)
    custom criteria: same code as in custom criteria of case "REQ_005_increment_waiting_state"

  case "REQ_015_decrement_duration_classes" [baseline]
    description: Requirement-derived MIL test using req_015_decrement_duration_classes_input.mat and req_015_decrement_duration_classes_baseline.mat.
    model crs_controller, harness crs_controller_harness, mode Normal
    input "req_015_decrement_duration_classes_input.mat", mapped to enbl, cncl, set, resume, inc, dec, brakeP, key, gear, throtDrv, vehSp (active)
    logged signals "RequirementOracleSignals": reqDrv, status, mode, targetSp, throtCC
    baseline "req_015_decrement_duration_classes_baseline.mat" (0 of 1 signals compared)
    custom criteria:
      yout = sltest_simout.get('yout');
      isDataset = isa(yout,'Simulink.SimulationData.Dataset');
      signalName = "reqDrv";
      if isDataset
          signalElement = yout.getElement(signalName);
          actual = signalElement.Values;
      else
          labels = string({yout.signals.label});
          signalPosition = find(labels == signalName,1);
          actual = timeseries(yout.signals(signalPosition).values,yout.time);
      end
      expectedTime = [0.01;0.02;0.51000000000000001];
      expectedData = [8;9;10];
      sampled = resample(actual,expectedTime,'zoh');
      test.verifyEqual(double(sampled.Data(:)),expectedData(:), ...
          sprintf('%s differs at an authored assessment time.',signalName));

  case "REQ_016_decrement_short_on_release" [baseline]
    description: Requirement-derived MIL test using req_016_decrement_short_on_release_input.mat and req_016_decrement_short_on_release_baseline.mat.
    model crs_controller, harness crs_controller_harness, mode Normal
    input "req_016_decrement_short_on_release_input.mat", mapped to enbl, cncl, set, resume, inc, dec, brakeP, key, gear, throtDrv, vehSp (active)
    logged signals "RequirementOracleSignals": reqDrv, status, mode, targetSp, throtCC
    baseline "req_016_decrement_short_on_release_baseline.mat" (0 of 1 signals compared)
    custom criteria:
      yout = sltest_simout.get('yout');
      isDataset = isa(yout,'Simulink.SimulationData.Dataset');
      signalName = "reqDrv";
      if isDataset
          signalElement = yout.getElement(signalName);
          actual = signalElement.Values;
      else
          labels = string({yout.signals.label});
          signalPosition = find(labels == signalName,1);
          actual = timeseries(yout.signals(signalPosition).values,yout.time);
      end
      expectedTime = 0.02;
      expectedData = 8;
      sampled = resample(actual,expectedTime,'zoh');
      test.verifyEqual(double(sampled.Data(:)),expectedData(:), ...
          sprintf('%s differs at an authored assessment time.',signalName));

  case "REQ_017_decrement_long" [baseline]
    description: Requirement-derived MIL test using req_017_decrement_long_input.mat and req_017_decrement_long_baseline.mat.
    model crs_controller, harness crs_controller_harness, mode Normal
    input "req_017_decrement_long_input.mat", mapped to enbl, cncl, set, resume, inc, dec, brakeP, key, gear, throtDrv, vehSp (active)
    logged signals "RequirementOracleSignals": reqDrv, status, mode, targetSp, throtCC
    baseline "req_017_decrement_long_baseline.mat" (0 of 1 signals compared)
    custom criteria:
      yout = sltest_simout.get('yout');
      isDataset = isa(yout,'Simulink.SimulationData.Dataset');
      signalName = "reqDrv";
      if isDataset
          signalElement = yout.getElement(signalName);
          actual = signalElement.Values;
      else
          labels = string({yout.signals.label});
          signalPosition = find(labels == signalName,1);
          actual = timeseries(yout.signals(signalPosition).values,yout.time);
      end
      expectedTime = 0.51000000000000001;
      expectedData = 10;
      sampled = resample(actual,expectedTime,'zoh');
      test.verifyEqual(double(sampled.Data(:)),expectedData(:), ...
          sprintf('%s differs at an authored assessment time.',signalName));

  case "REQ_018_decrement_middle" [baseline]
    description: Requirement-derived MIL test using req_018_decrement_middle_input.mat and req_018_decrement_middle_baseline.mat.
    model crs_controller, harness crs_controller_harness, mode Normal
    input "req_018_decrement_middle_input.mat", mapped to enbl, cncl, set, resume, inc, dec, brakeP, key, gear, throtDrv, vehSp (active)
    logged signals "RequirementOracleSignals": reqDrv, status, mode, targetSp, throtCC
    baseline "req_018_decrement_middle_baseline.mat" (0 of 1 signals compared)
    custom criteria: same code as in custom criteria of case "REQ_006_decrement_waiting_state"

  case "REQ_020_any_disable_condition" [baseline]
    description: Requirement-derived MIL test using req_020_any_disable_condition_input.mat and req_020_any_disable_condition_baseline.mat.
    model crs_controller, harness crs_controller_harness, mode Normal
    input "req_020_any_disable_condition_input.mat", mapped to enbl, cncl, set, resume, inc, dec, brakeP, key, gear, throtDrv, vehSp (active)
    logged signals "RequirementOracleSignals": reqDrv, status, mode, targetSp, throtCC
    baseline "req_020_any_disable_condition_baseline.mat" (0 of 1 signals compared)
    custom criteria:
      yout = sltest_simout.get('yout');
      isDataset = isa(yout,'Simulink.SimulationData.Dataset');
      signalName = "mode";
      if isDataset
          signalElement = yout.getElement(signalName);
          actual = signalElement.Values;
      else
          labels = string({yout.signals.label});
          signalPosition = find(labels == signalName,1);
          actual = timeseries(yout.signals(signalPosition).values,yout.time);
      end
      expectedTime = 0.02;
      expectedData = 0;
      sampled = resample(actual,expectedTime,'zoh');
      test.verifyEqual(double(sampled.Data(:)),expectedData(:), ...
          sprintf('%s differs at an authored assessment time.',signalName));

  case "REQ_021_key_not_on" [baseline]
    description: Requirement-derived MIL test using req_021_key_not_on_input.mat and req_021_key_not_on_baseline.mat.
    model crs_controller, harness crs_controller_harness, mode Normal
    input "req_021_key_not_on_input.mat", mapped to enbl, cncl, set, resume, inc, dec, brakeP, key, gear, throtDrv, vehSp (active)
    logged signals "RequirementOracleSignals": reqDrv, status, mode, targetSp, throtCC
    baseline "req_021_key_not_on_baseline.mat" (0 of 1 signals compared)
    custom criteria: same code as in custom criteria of case "REQ_020_any_disable_condition"

  case "REQ_022_gear_not_drive" [baseline]
    description: Requirement-derived MIL test using req_022_gear_not_drive_input.mat and req_022_gear_not_drive_baseline.mat.
    model crs_controller, harness crs_controller_harness, mode Normal
    input "req_022_gear_not_drive_input.mat", mapped to enbl, cncl, set, resume, inc, dec, brakeP, key, gear, throtDrv, vehSp (active)
    logged signals "RequirementOracleSignals": reqDrv, status, mode, targetSp, throtCC
    baseline "req_022_gear_not_drive_baseline.mat" (0 of 1 signals compared)
    custom criteria: same code as in custom criteria of case "REQ_020_any_disable_condition"

  case "REQ_023_brake_above_threshold" [baseline]
    description: Requirement-derived MIL test using req_023_brake_above_threshold_input.mat and req_023_brake_above_threshold_baseline.mat.
    model crs_controller, harness crs_controller_harness, mode Normal
    input "req_023_brake_above_threshold_input.mat", mapped to enbl, cncl, set, resume, inc, dec, brakeP, key, gear, throtDrv, vehSp (active)
    logged signals "RequirementOracleSignals": reqDrv, status, mode, targetSp, throtCC
    baseline "req_023_brake_above_threshold_baseline.mat" (0 of 1 signals compared)
    custom criteria: same code as in custom criteria of case "REQ_020_any_disable_condition"

  case "REQ_024_operation_mode_determination" [baseline]
    description: Requirement-derived MIL test using req_024_operation_mode_determination_input.mat and req_024_operation_mode_determination_baseline.mat.
    model crs_controller, harness crs_controller_harness, mode Normal
    input "req_024_operation_mode_determination_input.mat", mapped to enbl, cncl, set, resume, inc, dec, brakeP, key, gear, throtDrv, vehSp (active)
    logged signals "RequirementOracleSignals": reqDrv, status, mode, targetSp, throtCC
    baseline "req_024_operation_mode_determination_baseline.mat" (0 of 1 signals compared)
    custom criteria:
      yout = sltest_simout.get('yout');
      isDataset = isa(yout,'Simulink.SimulationData.Dataset');
      signalName = "mode";
      if isDataset
          signalElement = yout.getElement(signalName);
          actual = signalElement.Values;
      else
          labels = string({yout.signals.label});
          signalPosition = find(labels == signalName,1);
          actual = timeseries(yout.signals(signalPosition).values,yout.time);
      end
      expectedTime = 0;
      expectedData = 1;
      sampled = resample(actual,expectedTime,'zoh');
      test.verifyEqual(double(sampled.Data(:)),expectedData(:), ...
          sprintf('%s differs at an authored assessment time.',signalName));

  case "REQ_025_mode_precedence" [baseline]
    description: Requirement-derived MIL test using req_025_mode_precedence_input.mat and req_025_mode_precedence_baseline.mat.
    model crs_controller, harness crs_controller_harness, mode Normal
    input "req_025_mode_precedence_input.mat", mapped to enbl, cncl, set, resume, inc, dec, brakeP, key, gear, throtDrv, vehSp (active)
    logged signals "RequirementOracleSignals": reqDrv, status, mode, targetSp, throtCC
    baseline "req_025_mode_precedence_baseline.mat" (0 of 1 signals compared)
    custom criteria: same code as in custom criteria of case "REQ_020_any_disable_condition"

  case "REQ_026_disable_condition" [baseline]
    description: Requirement-derived MIL test using req_026_disable_condition_input.mat and req_026_disable_condition_baseline.mat.
    model crs_controller, harness crs_controller_harness, mode Normal
    input "req_026_disable_condition_input.mat", mapped to enbl, cncl, set, resume, inc, dec, brakeP, key, gear, throtDrv, vehSp (active)
    logged signals "RequirementOracleSignals": reqDrv, status, mode, targetSp, throtCC
    baseline "req_026_disable_condition_baseline.mat" (0 of 1 signals compared)
    custom criteria: same code as in custom criteria of case "REQ_020_any_disable_condition"

  case "REQ_030_retain_previous_mode" [baseline]
    description: Requirement-derived MIL test using req_030_retain_previous_mode_input.mat and req_030_retain_previous_mode_baseline.mat.
    model crs_controller, harness crs_controller_harness, mode Normal
    input "req_030_retain_previous_mode_input.mat", mapped to enbl, cncl, set, resume, inc, dec, brakeP, key, gear, throtDrv, vehSp (active)
    logged signals "RequirementOracleSignals": reqDrv, status, mode, targetSp, throtCC
    baseline "req_030_retain_previous_mode_baseline.mat" (0 of 1 signals compared)
    custom criteria:
      yout = sltest_simout.get('yout');
      isDataset = isa(yout,'Simulink.SimulationData.Dataset');
      signalName = "mode";
      if isDataset
          signalElement = yout.getElement(signalName);
          actual = signalElement.Values;
      else
          labels = string({yout.signals.label});
          signalPosition = find(labels == signalName,1);
          actual = timeseries(yout.signals(signalPosition).values,yout.time);
      end
      expectedTime = [0.01;0.02];
      expectedData = [1;1];
      sampled = resample(actual,expectedTime,'zoh');
      test.verifyEqual(double(sampled.Data(:)),expectedData(:), ...
          sprintf('%s differs at an authored assessment time.',signalName));

  case "REQ_036_disable_override" [baseline]
    description: Requirement-derived MIL test using req_036_disable_override_input.mat and req_036_disable_override_baseline.mat.
    model crs_controller, harness crs_controller_harness, mode Normal
    input "req_036_disable_override_input.mat", mapped to enbl, cncl, set, resume, inc, dec, brakeP, key, gear, throtDrv, vehSp (active)
    logged signals "RequirementOracleSignals": reqDrv, status, mode, targetSp, throtCC
    baseline "req_036_disable_override_baseline.mat" (0 of 1 signals compared)
    custom criteria: same code as in custom criteria of case "REQ_020_any_disable_condition"

  case "REQ_038_disabled_outputs" [baseline]
    description: Requirement-derived MIL test using req_038_disabled_outputs_input.mat and req_038_disabled_outputs_baseline.mat.
    model crs_controller, harness crs_controller_harness, mode Normal
    input "req_038_disabled_outputs_input.mat", mapped to enbl, cncl, set, resume, inc, dec, brakeP, key, gear, throtDrv, vehSp (active)
    logged signals "RequirementOracleSignals": reqDrv, status, mode, targetSp, throtCC
    baseline "req_038_disabled_outputs_baseline.mat" (0 of 2 signals compared)
    custom criteria:
      yout = sltest_simout.get('yout');
      isDataset = isa(yout,'Simulink.SimulationData.Dataset');
      signalName = "targetSp";
      if isDataset
          signalElement = yout.getElement(signalName);
          actual = signalElement.Values;
      else
          labels = string({yout.signals.label});
          signalPosition = find(labels == signalName,1);
          actual = timeseries(yout.signals(signalPosition).values,yout.time);
      end
      expectedTime = 0;
      expectedData = 40;
      sampled = resample(actual,expectedTime,'zoh');
      test.verifyEqual(double(sampled.Data(:)),expectedData(:), ...
          sprintf('%s differs at an authored assessment time.',signalName));
      signalName = "throtCC";
      if isDataset
          signalElement = yout.getElement(signalName);
          actual = signalElement.Values;
      else
          labels = string({yout.signals.label});
          signalPosition = find(labels == signalName,1);
          actual = timeseries(yout.signals(signalPosition).values,yout.time);
      end
      expectedTime = 0;
      expectedData = 30;
      sampled = resample(actual,expectedTime,'zoh');
      test.verifyEqual(double(sampled.Data(:)),expectedData(:), ...
          sprintf('%s differs at an authored assessment time.',signalName));

  case "REQ_039_enabled_outputs" [baseline]
    description: Requirement-derived MIL test using req_039_enabled_outputs_input.mat and req_039_enabled_outputs_baseline.mat.
    model crs_controller, harness crs_controller_harness, mode Normal
    input "req_039_enabled_outputs_input.mat", mapped to enbl, cncl, set, resume, inc, dec, brakeP, key, gear, throtDrv, vehSp (active)
    logged signals "RequirementOracleSignals": reqDrv, status, mode, targetSp, throtCC
    baseline "req_039_enabled_outputs_baseline.mat" (0 of 2 signals compared)
    custom criteria:
      yout = sltest_simout.get('yout');
      isDataset = isa(yout,'Simulink.SimulationData.Dataset');
      signalName = "targetSp";
      if isDataset
          signalElement = yout.getElement(signalName);
          actual = signalElement.Values;
      else
          labels = string({yout.signals.label});
          signalPosition = find(labels == signalName,1);
          actual = timeseries(yout.signals(signalPosition).values,yout.time);
      end
      expectedTime = 0.01;
      expectedData = 60;
      sampled = resample(actual,expectedTime,'zoh');
      test.verifyEqual(double(sampled.Data(:)),expectedData(:), ...
          sprintf('%s differs at an authored assessment time.',signalName));
      signalName = "throtCC";
      if isDataset
          signalElement = yout.getElement(signalName);
          actual = signalElement.Values;
      else
          labels = string({yout.signals.label});
          signalPosition = find(labels == signalName,1);
          actual = timeseries(yout.signals(signalPosition).values,yout.time);
      end
      expectedTime = 0.01;
      expectedData = 30;
      sampled = resample(actual,expectedTime,'zoh');
      test.verifyEqual(double(sampled.Data(:)),expectedData(:), ...
          sprintf('%s differs at an authored assessment time.',signalName));

suite "SLDV Coverage Gap"
  description: 48 SLDV-generated scenarios targeting residual MIL coverage objectives.

  case "SLDV_Coverage_Gap_001" [simulation]
    description: SLDV coverage-gap scenario 1 of 48.
    model crs_controller, harness crs_controller_harness, mode Normal
    input "sldv_coverage_gap_001_input.mat", mapped to enbl, cncl, set, resume, inc, dec, brakeP, key, gear, throtDrv, vehSp (active)
    pre-load callback:
      set_param('crs_controller','SignalRangeChecking','warning');set_param('crs_controller_harness','SignalRangeChecking','warning');

  case "SLDV_Coverage_Gap_002" [simulation]
    description: SLDV coverage-gap scenario 2 of 48.
    model crs_controller, harness crs_controller_harness, mode Normal
    input "sldv_coverage_gap_002_input.mat", mapped to enbl, cncl, set, resume, inc, dec, brakeP, key, gear, throtDrv, vehSp (active)
    pre-load callback: same code as in pre-load callback of case "SLDV_Coverage_Gap_001"

  case "SLDV_Coverage_Gap_003" [simulation]
    description: SLDV coverage-gap scenario 3 of 48.
    model crs_controller, harness crs_controller_harness, mode Normal
    input "sldv_coverage_gap_003_input.mat", mapped to enbl, cncl, set, resume, inc, dec, brakeP, key, gear, throtDrv, vehSp (active)
    pre-load callback: same code as in pre-load callback of case "SLDV_Coverage_Gap_001"

  case "SLDV_Coverage_Gap_004" [simulation]
    description: SLDV coverage-gap scenario 4 of 48.
    model crs_controller, harness crs_controller_harness, mode Normal
    input "sldv_coverage_gap_004_input.mat", mapped to enbl, cncl, set, resume, inc, dec, brakeP, key, gear, throtDrv, vehSp (active)
    pre-load callback: same code as in pre-load callback of case "SLDV_Coverage_Gap_001"

  case "SLDV_Coverage_Gap_005" [simulation]
    description: SLDV coverage-gap scenario 5 of 48.
    model crs_controller, harness crs_controller_harness, mode Normal
    input "sldv_coverage_gap_005_input.mat", mapped to enbl, cncl, set, resume, inc, dec, brakeP, key, gear, throtDrv, vehSp (active)
    pre-load callback: same code as in pre-load callback of case "SLDV_Coverage_Gap_001"

  case "SLDV_Coverage_Gap_006" [simulation]
    description: SLDV coverage-gap scenario 6 of 48.
    model crs_controller, harness crs_controller_harness, mode Normal
    input "sldv_coverage_gap_006_input.mat", mapped to enbl, cncl, set, resume, inc, dec, brakeP, key, gear, throtDrv, vehSp (active)
    pre-load callback: same code as in pre-load callback of case "SLDV_Coverage_Gap_001"

  case "SLDV_Coverage_Gap_007" [simulation]
    description: SLDV coverage-gap scenario 7 of 48.
    model crs_controller, harness crs_controller_harness, mode Normal
    input "sldv_coverage_gap_007_input.mat", mapped to enbl, cncl, set, resume, inc, dec, brakeP, key, gear, throtDrv, vehSp (active)
    pre-load callback: same code as in pre-load callback of case "SLDV_Coverage_Gap_001"

  case "SLDV_Coverage_Gap_008" [simulation]
    description: SLDV coverage-gap scenario 8 of 48.
    model crs_controller, harness crs_controller_harness, mode Normal
    input "sldv_coverage_gap_008_input.mat", mapped to enbl, cncl, set, resume, inc, dec, brakeP, key, gear, throtDrv, vehSp (active)
    pre-load callback: same code as in pre-load callback of case "SLDV_Coverage_Gap_001"

  case "SLDV_Coverage_Gap_009" [simulation]
    description: SLDV coverage-gap scenario 9 of 48.
    model crs_controller, harness crs_controller_harness, mode Normal
    input "sldv_coverage_gap_009_input.mat", mapped to enbl, cncl, set, resume, inc, dec, brakeP, key, gear, throtDrv, vehSp (active)
    pre-load callback: same code as in pre-load callback of case "SLDV_Coverage_Gap_001"

  case "SLDV_Coverage_Gap_010" [simulation]
    description: SLDV coverage-gap scenario 10 of 48.
    model crs_controller, harness crs_controller_harness, mode Normal
    input "sldv_coverage_gap_010_input.mat", mapped to enbl, cncl, set, resume, inc, dec, brakeP, key, gear, throtDrv, vehSp (active)
    pre-load callback: same code as in pre-load callback of case "SLDV_Coverage_Gap_001"

  case "SLDV_Coverage_Gap_011" [simulation]
    description: SLDV coverage-gap scenario 11 of 48.
    model crs_controller, harness crs_controller_harness, mode Normal
    input "sldv_coverage_gap_011_input.mat", mapped to enbl, cncl, set, resume, inc, dec, brakeP, key, gear, throtDrv, vehSp (active)
    pre-load callback: same code as in pre-load callback of case "SLDV_Coverage_Gap_001"

  case "SLDV_Coverage_Gap_012" [simulation]
    description: SLDV coverage-gap scenario 12 of 48.
    model crs_controller, harness crs_controller_harness, mode Normal
    input "sldv_coverage_gap_012_input.mat", mapped to enbl, cncl, set, resume, inc, dec, brakeP, key, gear, throtDrv, vehSp (active)
    pre-load callback: same code as in pre-load callback of case "SLDV_Coverage_Gap_001"

  case "SLDV_Coverage_Gap_013" [simulation]
    description: SLDV coverage-gap scenario 13 of 48.
    model crs_controller, harness crs_controller_harness, mode Normal
    input "sldv_coverage_gap_013_input.mat", mapped to enbl, cncl, set, resume, inc, dec, brakeP, key, gear, throtDrv, vehSp (active)
    pre-load callback: same code as in pre-load callback of case "SLDV_Coverage_Gap_001"

  case "SLDV_Coverage_Gap_014" [simulation]
    description: SLDV coverage-gap scenario 14 of 48.
    model crs_controller, harness crs_controller_harness, mode Normal
    input "sldv_coverage_gap_014_input.mat", mapped to enbl, cncl, set, resume, inc, dec, brakeP, key, gear, throtDrv, vehSp (active)
    pre-load callback: same code as in pre-load callback of case "SLDV_Coverage_Gap_001"

  case "SLDV_Coverage_Gap_015" [simulation]
    description: SLDV coverage-gap scenario 15 of 48.
    model crs_controller, harness crs_controller_harness, mode Normal
    input "sldv_coverage_gap_015_input.mat", mapped to enbl, cncl, set, resume, inc, dec, brakeP, key, gear, throtDrv, vehSp (active)
    pre-load callback: same code as in pre-load callback of case "SLDV_Coverage_Gap_001"

  case "SLDV_Coverage_Gap_016" [simulation]
    description: SLDV coverage-gap scenario 16 of 48.
    model crs_controller, harness crs_controller_harness, mode Normal
    input "sldv_coverage_gap_016_input.mat", mapped to enbl, cncl, set, resume, inc, dec, brakeP, key, gear, throtDrv, vehSp (active)
    pre-load callback: same code as in pre-load callback of case "SLDV_Coverage_Gap_001"

  case "SLDV_Coverage_Gap_017" [simulation]
    description: SLDV coverage-gap scenario 17 of 48.
    model crs_controller, harness crs_controller_harness, mode Normal
    input "sldv_coverage_gap_017_input.mat", mapped to enbl, cncl, set, resume, inc, dec, brakeP, key, gear, throtDrv, vehSp (active)
    pre-load callback: same code as in pre-load callback of case "SLDV_Coverage_Gap_001"

  case "SLDV_Coverage_Gap_018" [simulation]
    description: SLDV coverage-gap scenario 18 of 48.
    model crs_controller, harness crs_controller_harness, mode Normal
    input "sldv_coverage_gap_018_input.mat", mapped to enbl, cncl, set, resume, inc, dec, brakeP, key, gear, throtDrv, vehSp (active)
    pre-load callback: same code as in pre-load callback of case "SLDV_Coverage_Gap_001"

  case "SLDV_Coverage_Gap_019" [simulation]
    description: SLDV coverage-gap scenario 19 of 48.
    model crs_controller, harness crs_controller_harness, mode Normal
    input "sldv_coverage_gap_019_input.mat", mapped to enbl, cncl, set, resume, inc, dec, brakeP, key, gear, throtDrv, vehSp (active)
    pre-load callback: same code as in pre-load callback of case "SLDV_Coverage_Gap_001"

  case "SLDV_Coverage_Gap_020" [simulation]
    description: SLDV coverage-gap scenario 20 of 48.
    model crs_controller, harness crs_controller_harness, mode Normal
    input "sldv_coverage_gap_020_input.mat", mapped to enbl, cncl, set, resume, inc, dec, brakeP, key, gear, throtDrv, vehSp (active)
    pre-load callback: same code as in pre-load callback of case "SLDV_Coverage_Gap_001"

  case "SLDV_Coverage_Gap_021" [simulation]
    description: SLDV coverage-gap scenario 21 of 48.
    model crs_controller, harness crs_controller_harness, mode Normal
    input "sldv_coverage_gap_021_input.mat", mapped to enbl, cncl, set, resume, inc, dec, brakeP, key, gear, throtDrv, vehSp (active)
    pre-load callback: same code as in pre-load callback of case "SLDV_Coverage_Gap_001"

  case "SLDV_Coverage_Gap_022" [simulation]
    description: SLDV coverage-gap scenario 22 of 48.
    model crs_controller, harness crs_controller_harness, mode Normal
    input "sldv_coverage_gap_022_input.mat", mapped to enbl, cncl, set, resume, inc, dec, brakeP, key, gear, throtDrv, vehSp (active)
    pre-load callback: same code as in pre-load callback of case "SLDV_Coverage_Gap_001"

  case "SLDV_Coverage_Gap_023" [simulation]
    description: SLDV coverage-gap scenario 23 of 48.
    model crs_controller, harness crs_controller_harness, mode Normal
    input "sldv_coverage_gap_023_input.mat", mapped to enbl, cncl, set, resume, inc, dec, brakeP, key, gear, throtDrv, vehSp (active)
    pre-load callback: same code as in pre-load callback of case "SLDV_Coverage_Gap_001"

  case "SLDV_Coverage_Gap_024" [simulation]
    description: SLDV coverage-gap scenario 24 of 48.
    model crs_controller, harness crs_controller_harness, mode Normal
    input "sldv_coverage_gap_024_input.mat", mapped to enbl, cncl, set, resume, inc, dec, brakeP, key, gear, throtDrv, vehSp (active)
    pre-load callback: same code as in pre-load callback of case "SLDV_Coverage_Gap_001"

  case "SLDV_Coverage_Gap_025" [simulation]
    description: SLDV coverage-gap scenario 25 of 48.
    model crs_controller, harness crs_controller_harness, mode Normal
    input "sldv_coverage_gap_025_input.mat", mapped to enbl, cncl, set, resume, inc, dec, brakeP, key, gear, throtDrv, vehSp (active)
    pre-load callback: same code as in pre-load callback of case "SLDV_Coverage_Gap_001"

  case "SLDV_Coverage_Gap_026" [simulation]
    description: SLDV coverage-gap scenario 26 of 48.
    model crs_controller, harness crs_controller_harness, mode Normal
    input "sldv_coverage_gap_026_input.mat", mapped to enbl, cncl, set, resume, inc, dec, brakeP, key, gear, throtDrv, vehSp (active)
    pre-load callback: same code as in pre-load callback of case "SLDV_Coverage_Gap_001"

  case "SLDV_Coverage_Gap_027" [simulation]
    description: SLDV coverage-gap scenario 27 of 48.
    model crs_controller, harness crs_controller_harness, mode Normal
    input "sldv_coverage_gap_027_input.mat", mapped to enbl, cncl, set, resume, inc, dec, brakeP, key, gear, throtDrv, vehSp (active)
    pre-load callback: same code as in pre-load callback of case "SLDV_Coverage_Gap_001"

  case "SLDV_Coverage_Gap_028" [simulation]
    description: SLDV coverage-gap scenario 28 of 48.
    model crs_controller, harness crs_controller_harness, mode Normal
    input "sldv_coverage_gap_028_input.mat", mapped to enbl, cncl, set, resume, inc, dec, brakeP, key, gear, throtDrv, vehSp (active)
    pre-load callback: same code as in pre-load callback of case "SLDV_Coverage_Gap_001"

  case "SLDV_Coverage_Gap_029" [simulation]
    description: SLDV coverage-gap scenario 29 of 48.
    model crs_controller, harness crs_controller_harness, mode Normal
    input "sldv_coverage_gap_029_input.mat", mapped to enbl, cncl, set, resume, inc, dec, brakeP, key, gear, throtDrv, vehSp (active)
    pre-load callback: same code as in pre-load callback of case "SLDV_Coverage_Gap_001"

  case "SLDV_Coverage_Gap_030" [simulation]
    description: SLDV coverage-gap scenario 30 of 48.
    model crs_controller, harness crs_controller_harness, mode Normal
    input "sldv_coverage_gap_030_input.mat", mapped to enbl, cncl, set, resume, inc, dec, brakeP, key, gear, throtDrv, vehSp (active)
    pre-load callback: same code as in pre-load callback of case "SLDV_Coverage_Gap_001"

  case "SLDV_Coverage_Gap_031" [simulation]
    description: SLDV coverage-gap scenario 31 of 48.
    model crs_controller, harness crs_controller_harness, mode Normal
    input "sldv_coverage_gap_031_input.mat", mapped to enbl, cncl, set, resume, inc, dec, brakeP, key, gear, throtDrv, vehSp (active)
    pre-load callback: same code as in pre-load callback of case "SLDV_Coverage_Gap_001"

  case "SLDV_Coverage_Gap_032" [simulation]
    description: SLDV coverage-gap scenario 32 of 48.
    model crs_controller, harness crs_controller_harness, mode Normal
    input "sldv_coverage_gap_032_input.mat", mapped to enbl, cncl, set, resume, inc, dec, brakeP, key, gear, throtDrv, vehSp (active)
    pre-load callback: same code as in pre-load callback of case "SLDV_Coverage_Gap_001"

  case "SLDV_Coverage_Gap_033" [simulation]
    description: SLDV coverage-gap scenario 33 of 48.
    model crs_controller, harness crs_controller_harness, mode Normal
    input "sldv_coverage_gap_033_input.mat", mapped to enbl, cncl, set, resume, inc, dec, brakeP, key, gear, throtDrv, vehSp (active)
    pre-load callback: same code as in pre-load callback of case "SLDV_Coverage_Gap_001"

  case "SLDV_Coverage_Gap_034" [simulation]
    description: SLDV coverage-gap scenario 34 of 48.
    model crs_controller, harness crs_controller_harness, mode Normal
    input "sldv_coverage_gap_034_input.mat", mapped to enbl, cncl, set, resume, inc, dec, brakeP, key, gear, throtDrv, vehSp (active)
    pre-load callback: same code as in pre-load callback of case "SLDV_Coverage_Gap_001"

  case "SLDV_Coverage_Gap_035" [simulation]
    description: SLDV coverage-gap scenario 35 of 48.
    model crs_controller, harness crs_controller_harness, mode Normal
    input "sldv_coverage_gap_035_input.mat", mapped to enbl, cncl, set, resume, inc, dec, brakeP, key, gear, throtDrv, vehSp (active)
    pre-load callback: same code as in pre-load callback of case "SLDV_Coverage_Gap_001"

  case "SLDV_Coverage_Gap_036" [simulation]
    description: SLDV coverage-gap scenario 36 of 48.
    model crs_controller, harness crs_controller_harness, mode Normal
    input "sldv_coverage_gap_036_input.mat", mapped to enbl, cncl, set, resume, inc, dec, brakeP, key, gear, throtDrv, vehSp (active)
    pre-load callback: same code as in pre-load callback of case "SLDV_Coverage_Gap_001"

  case "SLDV_Coverage_Gap_037" [simulation]
    description: SLDV coverage-gap scenario 37 of 48.
    model crs_controller, harness crs_controller_harness, mode Normal
    input "sldv_coverage_gap_037_input.mat", mapped to enbl, cncl, set, resume, inc, dec, brakeP, key, gear, throtDrv, vehSp (active)
    pre-load callback: same code as in pre-load callback of case "SLDV_Coverage_Gap_001"

  case "SLDV_Coverage_Gap_038" [simulation]
    description: SLDV coverage-gap scenario 38 of 48.
    model crs_controller, harness crs_controller_harness, mode Normal
    input "sldv_coverage_gap_038_input.mat", mapped to enbl, cncl, set, resume, inc, dec, brakeP, key, gear, throtDrv, vehSp (active)
    pre-load callback: same code as in pre-load callback of case "SLDV_Coverage_Gap_001"

  case "SLDV_Coverage_Gap_039" [simulation]
    description: SLDV coverage-gap scenario 39 of 48.
    model crs_controller, harness crs_controller_harness, mode Normal
    input "sldv_coverage_gap_039_input.mat", mapped to enbl, cncl, set, resume, inc, dec, brakeP, key, gear, throtDrv, vehSp (active)
    pre-load callback: same code as in pre-load callback of case "SLDV_Coverage_Gap_001"

  case "SLDV_Coverage_Gap_040" [simulation]
    description: SLDV coverage-gap scenario 40 of 48.
    model crs_controller, harness crs_controller_harness, mode Normal
    input "sldv_coverage_gap_040_input.mat", mapped to enbl, cncl, set, resume, inc, dec, brakeP, key, gear, throtDrv, vehSp (active)
    pre-load callback: same code as in pre-load callback of case "SLDV_Coverage_Gap_001"

  case "SLDV_Coverage_Gap_041" [simulation]
    description: SLDV coverage-gap scenario 41 of 48.
    model crs_controller, harness crs_controller_harness, mode Normal
    input "sldv_coverage_gap_041_input.mat", mapped to enbl, cncl, set, resume, inc, dec, brakeP, key, gear, throtDrv, vehSp (active)
    pre-load callback: same code as in pre-load callback of case "SLDV_Coverage_Gap_001"

  case "SLDV_Coverage_Gap_042" [simulation]
    description: SLDV coverage-gap scenario 42 of 48.
    model crs_controller, harness crs_controller_harness, mode Normal
    input "sldv_coverage_gap_042_input.mat", mapped to enbl, cncl, set, resume, inc, dec, brakeP, key, gear, throtDrv, vehSp (active)
    pre-load callback: same code as in pre-load callback of case "SLDV_Coverage_Gap_001"

  case "SLDV_Coverage_Gap_043" [simulation]
    description: SLDV coverage-gap scenario 43 of 48.
    model crs_controller, harness crs_controller_harness, mode Normal
    input "sldv_coverage_gap_043_input.mat", mapped to enbl, cncl, set, resume, inc, dec, brakeP, key, gear, throtDrv, vehSp (active)
    pre-load callback: same code as in pre-load callback of case "SLDV_Coverage_Gap_001"

  case "SLDV_Coverage_Gap_044" [simulation]
    description: SLDV coverage-gap scenario 44 of 48.
    model crs_controller, harness crs_controller_harness, mode Normal
    input "sldv_coverage_gap_044_input.mat", mapped to enbl, cncl, set, resume, inc, dec, brakeP, key, gear, throtDrv, vehSp (active)
    pre-load callback: same code as in pre-load callback of case "SLDV_Coverage_Gap_001"

  case "SLDV_Coverage_Gap_045" [simulation]
    description: SLDV coverage-gap scenario 45 of 48.
    model crs_controller, harness crs_controller_harness, mode Normal
    input "sldv_coverage_gap_045_input.mat", mapped to enbl, cncl, set, resume, inc, dec, brakeP, key, gear, throtDrv, vehSp (active)
    pre-load callback: same code as in pre-load callback of case "SLDV_Coverage_Gap_001"

  case "SLDV_Coverage_Gap_046" [simulation]
    description: SLDV coverage-gap scenario 46 of 48.
    model crs_controller, harness crs_controller_harness, mode Normal
    input "sldv_coverage_gap_046_input.mat", mapped to enbl, cncl, set, resume, inc, dec, brakeP, key, gear, throtDrv, vehSp (active)
    pre-load callback: same code as in pre-load callback of case "SLDV_Coverage_Gap_001"

  case "SLDV_Coverage_Gap_047" [simulation]
    description: SLDV coverage-gap scenario 47 of 48.
    model crs_controller, harness crs_controller_harness, mode Normal
    input "sldv_coverage_gap_047_input.mat", mapped to enbl, cncl, set, resume, inc, dec, brakeP, key, gear, throtDrv, vehSp (active)
    pre-load callback: same code as in pre-load callback of case "SLDV_Coverage_Gap_001"

  case "SLDV_Coverage_Gap_048" [simulation]
    description: SLDV coverage-gap scenario 48 of 48.
    model crs_controller, harness crs_controller_harness, mode Normal
    input "sldv_coverage_gap_048_input.mat", mapped to enbl, cncl, set, resume, inc, dec, brakeP, key, gear, throtDrv, vehSp (active)
    pre-load callback: same code as in pre-load callback of case "SLDV_Coverage_Gap_001"